# Grasshopper definition cluster.gh (Grasshopper 1.0.8)
# plug-ins: CORE.Toolbox.Grasshopper, Heteroptera, Pufferfish, eleFront, Telepathy

riser_vector = RemoteSender()
riser_curve = RemoteSender()
thickness = RemoteSender()
type = RemoteSender()
riser_curve_2 = RemoteSender(riser_curve)
riser_vector_2 = RemoteSender(riser_vector)
thickness_2 = RemoteSender(thickness)
type_2 = RemoteSender(type)
riser_vector_3 = RemoteReceiver(riser_vector_2)
riser_curve_3 = RemoteReceiver(riser_curve_2)
type_3 = RemoteReceiver(type_2)
cluster = Cluster(riser_curve=riser_curve_3, riser_vector=riser_vector_3, type=type_3)  # -> flowed_step_curve_3, flow_curve_1_3, cut_points_0_2, shape_2, cut_points_1_2, G, shape_4
shape = RemoteSender(cluster.shape_2)
neg = Negative(Value=Slider(100, range=0..100))
thickness_3 = RemoteReceiver(thickness_2)
xz = XZPlane(Origin=Point(0, 0, 0))
flip = FlipMatrix()
explode = Explode(Curve=flip, Recursive=True)  # -> Segments, Vertices
pdecon = Deconstruct(Point=explode.Vertices)  # -> XComponent, YComponent, ZComponent
int = Integer(pdecon.ZComponent)
cset = CreateSet(List=int)  # -> Set, Map
mindex = MemberIndex(Set=int, Member=cset.Set)  # -> Index, Count
item = ListItem(List=simplify(explode.Vertices), Index=simplify(mindex.Index), Wrap=True)
pdecon_2 = Deconstruct(Point=item)  # -> XComponent, YComponent, ZComponent
flow_curve_1 = RemoteReceiver(flatten(cluster.flow_curve_1_3))
sort = SortList(Keys=pdecon_2.XComponent, ValuesA=item)  # -> Keys, ValuesA
end = EndPoints(Curve=flow_curve_1)  # -> Start, End
item_2 = ListItem(List=sort.ValuesA, Index=0, Wrap=True)  # -> Item1, Item
merge = Merge(Data1=end.Start, Data2=end.End)
merge_2 = Merge(Data1=item_2.Item, Data2=item_2.Item1)  # -> flatten(Result)
Z = UnitZ(Factor=Slider(5000, range=0..10000))
cullpt = CullDuplicates(Points=merge, Tolerance=0.1, CullMode=1)  # -> Points, Indices, Valence
neg_2 = Negative(Value=Z)
pline = PolyLine(Vertices=merge_2, Closed=False)
offcrv = OffsetCurve(Curve=simplify(pline), Plane=xz, Distance=graft(Slider(177, range=0..300)), BothSides=neg, Kinks=0, CapType=1)  # -> simplify(Offset)
boundary = BoundarySurfaces(Edges=offcrv)
Z_2 = UnitZ(Factor=1)
flow_curve_0 = RemoteReceiver()
line = LineSDL(Start=cullpt.Points, Direction=Z_2, Length=Slider(10000, range=0..10000))
move = Move(Geometry=line, Motion=neg_2)  # -> Geometry, Transform
S = Surfaces()
unset = RemoteSender()
shape_2 = RemoteReceiver(cluster.shape_4)
srfsplit = SurfaceSplit(Curves=move.Geometry)
neg_3 = Negative(Value=Slider(100, range=0..100))
shape_3 = RemoteReceiver(shape_2)
center = Center(Geometry=srfsplit)  # -> Center, Dimension
pdecon_3 = Deconstruct(Point=center.Center)  # -> XComponent, YComponent, ZComponent
thickness_4 = RemoteReceiver(thickness_2)
xz_2 = XZPlane(Origin=Point(0, 0, 0))
sort_2 = SortList(Keys=pdecon_3.XComponent, ValuesA=srfsplit)  # -> Keys, ValuesA
offcrv_2 = OffsetCurve(Curve=simplify(pline), Plane=xz_2, Distance=graft(Slider(177, range=0..300)), BothSides=neg_3, Kinks=0, CapType=1)  # -> simplify(Offset)
join = JoinCurves(Curves=flow_curve_0, Preserve=False)
flow_curve_0_2 = RemoteReceiver()
boundary_2 = BoundarySurfaces(Edges=offcrv_2)
explode_2 = Explode(Curve=join, Recursive=True)  # -> Segments, Vertices
srfsplit_2 = SurfaceSplit(Surface=flatten(boundary_2), Curves=cluster.G)  # -> simplify(Fragments)
end_2 = EndPoints(Curve=explode_2.Segments)  # -> Start, End
vec2pt = Vector2Pt(PointA=end_2.Start, PointB=end_2.End, Unitize=invert(False))  # -> Vector, Length
flow_curve_0_3 = RemoteReceiver()
_1 = Integer(1)
shfdep = ShiftToDepth(Tree=srfsplit_2, Depth=_1, shiftFromStart=False)
cset_2 = CreateSet(List=vec2pt.Vector)  # -> Set, Map
flip_2 = FlipMatrix(Data=shfdep)
mindex_2 = MemberIndex(Set=vec2pt.Vector, Member=cset_2.Set)  # -> Index, Count
join_2 = BrepJoin(Breps=flip_2)  # -> Breps, Closed
item_3 = ListItem(List=explode_2.Segments, Index=mindex_2.Index, Wrap=True)
center_2 = Center(Geometry=join_2.Breps)  # -> flatten(Center), Dimension
tstat = TreeStatistics(Tree=join_2.Breps)  # -> Paths, Length, Count
join_3 = JoinCurves(Curves=item_3, Preserve=False)
pdecon_4 = Deconstruct(Point=center_2.Center)  # -> XComponent, YComponent, ZComponent
end_3 = EndPoints(Curve=join_3)  # -> Start, End
series = Series(Start=0, Step=1, Count=tstat.Count)
merge_3 = Merge(Data1=end_3.Start, Data2=end_3.End)  # -> flatten(Result)
flow_curve_1_2 = RemoteReceiver(flatten(cluster.flow_curve_1_3))
cut_points_1 = RemoteReceiver(cluster.cut_points_1_2)
cut_points_0 = RemoteReceiver(cluster.cut_points_0_2)
cullpt_2 = CullDuplicates(Points=merge_3, Tolerance=0.1, CullMode=2)  # -> Points, Indices, Valence
sort_3 = SortList(Keys=pdecon_4.XComponent, ValuesA=series)  # -> Keys, ValuesA
cull_i = CullIndex(List=merge_3, Indices=cullpt_2.Indices, Wrap=True)
crv_cp = CurveClosestPoint(Point=cut_points_0, Curve=join)  # -> Point, Parameter, Distance
join_4 = JoinCurves(Curves=flow_curve_1_2, Preserve=False)
crv_cp_2 = CurveClosestPoint(Point=cut_points_1, Curve=join_4)  # -> Point, Parameter, Distance
branch = BranchByIndex(Tree=flip_2, Branch=sort_3.ValuesA)
cullpt_3 = CullDuplicates(Points=cull_i, Tolerance=0.1, CullMode=1)  # -> Points, Indices, Valence
shatter = Shatter(Curve=join_4, Parameters=crv_cp_2.Parameter)
shatter_2 = Shatter(Curve=join, Parameters=crv_cp.Parameter)
flow = Flow(
    Geometry=graft(sort_2.ValuesA),
    Base=simplify(graft(flow_curve_1_2)),
    Target=graft(flow_curve_0),
    ReverseBase=invert(False),
    ReverseTarget=False,
    Stretch=True,
    Rigid=False)
number_slider = Slider(54, range=0..100)
join_5 = BrepJoin(Breps=flatten(flow))  # -> Breps, Closed
neg_4 = Negative(Value=Slider(100, range=0..1000))
number_slider_2 = Slider(100, range=0..100)
fmerge = MergeFaces(Brep=join_5.Breps)  # -> Breps, Before, After
type_4 = RemoteReceiver(type_2)
neg_5 = Negative(Value=number_slider_2)
filter = StreamFilter(Gate=type_4, Stream0=number_slider_2, Stream1=neg_5)
offsrf = OffsetSurface(Surface=fmerge.Breps, Distance=filter, BothSides=0, CreateSolid=True)
join_6 = BrepJoin(Breps=offsrf)  # -> Breps, Closed
sunion = SolidUnion(Breps=join_6.Breps)
shape_4 = RemoteReceiver(cluster.shape_4)
shape_5 = RemoteReceiver(shape_4)

# ==== cluster Cluster
riser_curve = ClusterInput()
riser_vector = ClusterInput()
type = ClusterInput()
riser_vector_2 = RemoteSender(riser_vector)
riser_curve_2 = RemoteSender(riser_curve)
type_2 = RemoteSender(type)
inner_bool = RemoteSender(Slider(0, range=0..1))
riser_vector_3 = RemoteReceiver(riser_vector_2)
riser_curve_3 = RemoteReceiver(riser_curve_2)
type_3 = RemoteReceiver(type_2)
_2 = Integer(2)
move = Move(Geometry=riser_curve_3, Motion=riser_vector_3)  # -> Geometry, Transform
addition = Addition(A=type_3, B=_2)
item = ListItem(List=move.Geometry, Index=addition, Wrap=True)
neg = Negative(Value=Slider(10, range=0..100))
_0 = Integer(0)
offcrv = OffsetCurve(Curve=item, Plane=PlaneXY(0, 0, 0), Distance=neg, BothSides=0, Kinks=0, CapType=_0)
selected_riser_curve = RemoteSender(offcrv)
selected_riser_curve_2 = RemoteReceiver(selected_riser_curve)
midpt = CurveMiddle(Curve=selected_riser_curve_2)
pdecon = Deconstruct(Point=midpt)  # -> XComponent, YComponent, ZComponent
neg_2 = Negative(Value=pdecon.ZComponent)
selected_riser_curve_3 = RemoteReceiver(selected_riser_curve)
Z = UnitZ(Factor=neg_2)
move_2 = Move(Geometry=selected_riser_curve_3, Motion=Z)  # -> flatten(Geometry), Transform
flow_curve_0 = RemoteSender(move_2.Geometry)
selected_riser_curve_4 = RemoteReceiver(selected_riser_curve)
flow_curve_0_2 = RemoteReceiver(flow_curve_0)
len = Length(Curve=flow_curve_0_2)  # -> flatten(Length)
ma = MassAddition(Input=len)  # -> Result, PartialResults
integer = Integer(-1)
cull_i = CullIndex(List=flatten(ma.PartialResults), Indices=integer, Wrap=True)
flow_curve_0_3 = RemoteReceiver(flatten(flow_curve_0))
_0_2 = Integer(0)
merge = Merge(Data1=flatten(_0_2), Data2=flatten(cull_i))
end = EndPoints(Curve=flow_curve_0_3)  # -> Start, End
merge_2 = Merge(Data1=end.Start, Data2=end.End)
cullpt = CullDuplicates(Points=flatten(merge_2), Tolerance=0.1, CullMode=1)  # -> Points, Indices, Valence
pt = ConstructPoint(XCoordinate=merge, YCoordinate=0, ZCoordinate=0)
pt_2 = ConstructPoint(XCoordinate=ma.PartialResults, YCoordinate=0, ZCoordinate=0)
flow_curve_0_4 = RemoteReceiver(flow_curve_0)
cut_points_0 = RemoteSender(cullpt.Points)
join = JoinCurves(Curves=flatten(flow_curve_0_4), Preserve=False)
ln = Line(StartPoint=pt, EndPoint=pt_2)
flow_curve_1 = RemoteSender(ln)
flow_curve_1_2 = RemoteReceiver(flow_curve_1)
join_2 = JoinCurves(Curves=flatten(flow_curve_1_2), Preserve=False)
cut_points_0_2 = ClusterOutput(cut_points_0)
cut_points_0_3 = RemoteReceiver(cut_points_0)
flow_curve_1_3 = ClusterOutput(flow_curve_1)
selected_riser_curve_5 = RemoteReceiver(selected_riser_curve)
flow_curve_0_5 = RemoteReceiver(flow_curve_0)
flow_curve_1_4 = RemoteReceiver(flow_curve_1)
flow = Flow(
    Geometry=cut_points_0_3,
    Base=join,
    Target=graft(join_2),
    ReverseBase=False,
    ReverseTarget=False,
    Stretch=True,
    Rigid=False)  # -> flatten(Geometry)
flow_2 = Flow(
    Geometry=selected_riser_curve_5,
    Base=graft(flow_curve_0_5),
    Target=graft(flow_curve_1_4),
    ReverseBase=False,
    ReverseTarget=False,
    Stretch=True,
    Rigid=False)  # -> flatten(Geometry)
cut_points_1 = RemoteSender(flow)
flowed_step_curve = RemoteSender(flow_2)
flowed_step_curve_2 = RemoteReceiver(flowed_step_curve)
cut_points_1_2 = ClusterOutput(cut_points_1)
flowed_step_curve_3 = ClusterOutput(flowed_step_curve)
end_2 = EndPoints(Curve=flatten(flowed_step_curve_2))  # -> Start, End
integer_2 = Integer(-1)
_0_3 = Integer(0)
cull_i_2 = CullIndex(List=flatten(end_2.End), Indices=integer_2, Wrap=True)
cull_i_3 = CullIndex(List=flatten(end_2.Start), Indices=_0_3, Wrap=True)
flowed_step_curve_4 = RemoteReceiver(flowed_step_curve)
ln_2 = Line(StartPoint=cull_i_2, EndPoint=cull_i_3)  # -> graft(Line)
merge_3 = Merge(Data1=simplify(flowed_step_curve_4), Data2=simplify(ln_2))
join_3 = JoinCurves(Curves=flatten(merge_3), Preserve=False)
explode = Explode(Curve=join_3, Recursive=True)  # -> Segments, Vertices
pline = PolyLine(Vertices=explode.Vertices, Closed=False)  # -> flatten(Polyline)
join_4 = JoinCurves(Curves=pline, Preserve=False)
neg_3 = Negative(Value=Slider(61, range=0..100))
xz = XZPlane(Origin=Point(0, 0, 0))
_0_4 = Integer(0)
cut_points_1_3 = RemoteReceiver(cut_points_1)
panel = Panel("""-1
0""")
offcrv_2 = OffsetCurve(Curve=simplify(flatten(join_4)), Plane=xz, Distance=Slider(69, range=0..300), BothSides=neg_3, Kinks=0, CapType=_0_4)
item_2 = ListItem(List=cut_points_1_3, Index=panel, Wrap=True)
Z_2 = UnitZ(Factor=1)
_100000 = Integer(100000)
number_slider = Slider(100, range=0..100)
ext = ExtendCurve(Curve=offcrv_2, Type=0, Start=number_slider, End=number_slider)
line = LineSDL(Start=item_2, Direction=Z_2, Length=_100000)
ccx = CurveCurve(CurveA=simplify(graft(ext)), CurveB=line)  # -> Points, ParamsA, ParamsB
cut_points_1_4 = RemoteReceiver(cut_points_1)
Z_3 = UnitZ(Factor=1)
_100000_2 = Integer(100000)
pshift = ShiftPaths(Data=ccx.Points, Offset=-1)
ptstrimcrv = PointsTrimCurve(Curve=graft(ext), Points=pshift, Flip=invert(False))  # -> Trimmed, SubDomains, Intersected
line_2 = LineSDL(Start=cut_points_1_4, Direction=Z_3, Length=_100000_2)
_2_2 = Integer(2)
end_3 = EndPoints(Curve=ptstrimcrv.Trimmed)  # -> Start, End
division = Division(A=_100000_2, B=_2_2)
pline_2 = PolyLine(Vertices=flatten(end_3.Start), Closed=False)
pline_3 = PolyLine(Vertices=flatten(end_3.End), Closed=False)
neg_4 = Negative(Value=division)
Z_4 = UnitZ(Factor=neg_4)
merge_4 = Merge(Data1=pline_2, Data2=pline_3, Data3=ptstrimcrv.Trimmed)  # -> flatten(Result)
move_3 = Move(Geometry=line_2, Motion=Z_4)  # -> Geometry, Transform
join_5 = JoinCurves(Curves=merge_4, Preserve=False)
boundary = BoundarySurfaces(Edges=join_5)
G = ClusterOutput(move_3.Geometry)
srfsplit = SurfaceSplit(Surface=boundary, Curves=move_3.Geometry)
shape = RemoteSender(boundary)
midpt_2 = CurveMiddle(Curve=srfsplit)
shape_2 = ClusterOutput(shape)
flow_curve_1_5 = RemoteReceiver(flatten(flow_curve_1))
flow_curve_0_6 = RemoteReceiver(flatten(flow_curve_0))
pdecon_2 = Deconstruct(Point=midpt_2)  # -> XComponent, YComponent, ZComponent
sort = SortList(Keys=pdecon_2.ZComponent, ValuesA=srfsplit)  # -> Keys, reverse(ValuesA)
flow_3 = Flow(
    Geometry=simplify(graft(sort.ValuesA)),
    Base=simplify(graft(flow_curve_1_5)),
    Target=graft(flow_curve_0_6),
    ReverseBase=False,
    ReverseTarget=False,
    Stretch=True,
    Rigid=False)
number_slider_2 = Slider(54, range=0..100)
join_6 = BrepJoin(Breps=flatten(flow_3))  # -> Breps, Closed
number_slider_3 = Slider(10, range=0..100)
fmerge = MergeFaces(Brep=join_6.Breps)  # -> Breps, Before, After
type_4 = RemoteReceiver(type_2)
neg_5 = Negative(Value=number_slider_3)
filter = StreamFilter(Gate=type_4, Stream0=number_slider_3, Stream1=neg_5)
offsrf = OffsetSurface(Surface=fmerge.Breps, Distance=filter, BothSides=0, CreateSolid=True)
join_7 = BrepJoin(Breps=offsrf)  # -> Breps, Closed
sunion = SolidUnion(Breps=join_7.Breps)
shape_3 = RemoteSender(sunion)
shape_4 = ClusterOutput(shape_3)
