# Grasshopper definition create_beam.gh (Grasshopper 1.0.8)
# plug-ins: jSwan, CORE.Toolbox.Grasshopper, Pufferfish, Telepathy

all_values_json = RemoteSender()
all_values_json_2 = RemoteSender(all_values_json)
panel = Panel("""Taşıyıcı A Durum
Cam A Durum
Taşıyıcı Tipi A
Cidar Tipi A
Taşıyıcı A Kalınlığı (cm)
Taşıyıcı A Cam Kalınlığı (mm)
Taşıyıcı A Sac Kalınlığı (mm)""")
panel_2 = Panel("""Taşıyıcı B Durum
Cam B Durum
Taşıyıcı Tipi B
Cidar Tipi B
Taşıyıcı B Kalınlığı (cm)
Taşıyıcı B Cam Kalınlığı (mm)
Taşıyıcı B Sac Kalınlığı (mm)""")
all_values_json_3 = RemoteReceiver(all_values_json_2)
_0 = Integer(0)
_2 = Integer(2)
_0_2 = Integer(0)
surface_to_flow = Surface_to_flow()
curve = Curve()
riser_vector = RemoteSender()
riser_curve = RemoteSender()
type = RemoteSender()
type_2 = RemoteSender(type)
type_3 = RemoteReceiver(type_2)
type_4 = RemoteReceiver(type_2)
filter = StreamFilter(Gate=type_3, Stream0=" A", Stream1=" B")
filter_2 = StreamFilter(Gate=type_4, Stream0=panel, Stream1=panel_2)
merge = Merge(Data1="Basamak Dağılımı Türü", Data2=filter_2)
dejsonkv = DeserializeKeysAndValues(JSON=all_values_json_3, Keys=merge)  # -> Key, Value
rep = ReplaceText(Text=dejsonkv.Key, Find=filter, Replace=" ", RecursiveReplace=False)
rejsonkv = SerializeKeysAndValues(Key=rep, Value=dejsonkv.Value)
type_5 = RemoteReceiver(type_2)
dejson = DeserializeJson(JSON=rejsonkv, OutputsLocked=False)  # -> BasamakDağılımıTürü, TaşıyıcıDurum, CamDurum, TaşıyıcıTipi, CidarTipi, TaşıyıcıKalınlığıCm, TaşıyıcıCamKalınlığıMm, TaşıyıcıSacKalınlığıMm
equals = Equality(FirstNumber=type_5, SecondNumber=_0)  # -> Equality, Inequality
filter_3 = StreamFilter(Gate=equals.Equality, Stream0=_2, Stream1=_0_2)
int = Integer(dejson.BasamakDağılımıTürü)
int_2 = Integer(dejson.TaşıyıcıDurum)
int_3 = Integer(dejson.CamDurum)
int_4 = Integer(dejson.CidarTipi)
int_5 = Integer(dejson.TaşıyıcıKalınlığıCm)
int_6 = Integer(dejson.TaşıyıcıTipi)
int_7 = Integer(dejson.TaşıyıcıCamKalınlığıMm)
int_8 = Integer(dejson.TaşıyıcıSacKalınlığıMm)
glass_booleaan = RemoteSender(int_3)
beam_type = RemoteSender(int_6)
beam_booleaan = RemoteSender(int_2)
sheet_thickness = RemoteSender(int_8)
branch = BranchByIndex(Tree=curve, Branch=filter_3)
riser_curve_2 = RemoteSender(riser_curve)
riser_vector_2 = RemoteSender(riser_vector)
curve_2 = RemoteSender(branch)
type_6 = RemoteReceiver(type_2)
beam_booleaan_2 = RemoteReceiver(beam_booleaan)
beam_type_2 = RemoteReceiver(beam_type)
riser_curve_3 = RemoteReceiver(riser_curve_2)
_0_3 = Integer(0)
concat = Concatenate(FragmentA=type_6, FragmentB=";0")
gate = StreamGate(Stream=riser_curve_3, Gate=beam_booleaan_2)  # -> Target0, Target1
equals_2 = Equality(FirstNumber=beam_type_2, SecondNumber=_0_3)  # -> Equality, Inequality
branch_2 = TreeBranch(Tree=surface_to_flow, Path=concat, MaintainPaths=True)
xz = XZPlane(Origin=Point(0, 0, 0))
gate_2 = StreamGate(Stream=gate.Target1, Gate=equals_2.Equality)  # -> Target0, Target1
brec = BoundingRectangle(Geometry=branch_2, Plane=xz, Axis=0, Slide=0, Union=True)  # -> Bounding, DimensionX, DimensionY
all_values_json_4 = RemoteReceiver(all_values_json_2)
sheet_thickness_2 = RemoteReceiver(sheet_thickness)
type_7 = RemoteReceiver(type_2)
end = EndPoints(Curve=brec.Bounding)  # -> Start, End
all_values_json_5 = RemoteReceiver(all_values_json_2)
curve_3 = RemoteReceiver(curve_2)
riser_vector_3 = RemoteReceiver(riser_vector_2)
curve_4 = RemoteReceiver(curve_2)
pdecon = Deconstruct(Point=end.Start)  # -> XComponent, YComponent, ZComponent
cluster = Cluster_13(
    curve=curve_4,
    riser_curve=gate_2.Target1,
    riser_vector=riser_vector_3,
    type=Slider(0, range=0..100),
    all_values_json=all_values_json_5)
pt = ConstructPoint(XCoordinate=0, YCoordinate=0, ZCoordinate=pdecon.ZComponent)
move2pt = MoveToPoint(Geometry=branch_2, PointA=end.Start, PointB=pt)  # -> Moved, Vector, Transform
beam = RemoteSender(flatten(cluster))
join = BrepJoin(Breps=move2pt.Moved)  # -> Breps, Closed
edges = BrepEdges(Brep=join.Breps)  # -> Naked, Interior, NonManifold
join_2 = JoinCurves(Curves=edges.Naked, Preserve=False)
boundary = BoundarySurfaces(Edges=join_2)
surface_to_flow_2 = RemoteSender(boundary)
surface_to_flow_3 = RemoteReceiver(surface_to_flow_2)
cluster_2 = Cluster_12(
    curve=curve_3,
    riser_curve=gate_2.Target0,
    surface_to_flow=surface_to_flow_3,
    all_values_json=all_values_json_4,
    type=type_7)
beam_2 = RemoteSender(flatten(cluster_2))
beam_3 = RemoteReceiver([beam_2, beam])
null = NullItem(Item=beam_3)  # -> NullFlags, InvalidFlags, Description
dispatch = Dispatch(List=beam_3, DispatchPattern=null.InvalidFlags)  # -> ListA, ListB
B = ListB(dispatch.ListB)

# ==== cluster Cluster_12
all_values_json = ClusterInput()
surface_to_flow = ClusterInput()
curve = ClusterInput()
type = ClusterInput()
riser_curve = ClusterInput()
curve_2 = RemoteSender(curve)
all_values_json_2 = RemoteSender(all_values_json)
surface_to_flow_2 = RemoteSender(surface_to_flow)
type_2 = RemoteSender(type)
riser_curve_2 = RemoteSender(riser_curve)
panel = Panel("""Taşıyıcı A Durum
Cam A Durum
Taşıyıcı Tipi A
Cidar Tipi A
Taşıyıcı A Kalınlığı (cm)
Taşıyıcı A Cam Kalınlığı (mm)
Taşıyıcı A Sac Kalınlığı (mm)""")
panel_2 = Panel("""Taşıyıcı B Durum
Cam B Durum
Taşıyıcı Tipi B
Cidar Tipi B
Taşıyıcı B Kalınlığı (cm)
Taşıyıcı B Cam Kalınlığı (mm)
Taşıyıcı B Sac Kalınlığı (mm)""")
type_3 = RemoteReceiver(type_2)
all_values_json_3 = RemoteReceiver(all_values_json_2)
riser_curve_3 = RemoteReceiver(riser_curve_2)
curve_3 = RemoteReceiver(curve_2)
type_4 = RemoteReceiver(type_2)
all_values_json_4 = RemoteReceiver(all_values_json_2)
type_5 = RemoteReceiver(type_2)
filter = StreamFilter(Gate=type_3, Stream0=" A", Stream1=" B")
filter_2 = StreamFilter(Gate=type_5, Stream0=panel, Stream1=panel_2)
merge = Merge(Data1="Basamak Dağılımı Türü", Data2=filter_2)
dejsonkv = DeserializeKeysAndValues(JSON=all_values_json_4, Keys=merge)  # -> Key, Value
rep = ReplaceText(Text=dejsonkv.Key, Find=filter, Replace=" ", RecursiveReplace=False)
flow_curve_0 = RemoteReceiver()
flow_curve_0_2 = RemoteReceiver()
flow_curve_1 = RemoteReceiver()
rejsonkv = SerializeKeysAndValues(Key=rep, Value=dejsonkv.Value)
dejson = DeserializeJson(JSON=rejsonkv, OutputsLocked=False)  # -> BasamakDağılımıTürü, TaşıyıcıDurum, CamDurum, TaşıyıcıTipi, CidarTipi, TaşıyıcıKalınlığıCm, TaşıyıcıCamKalınlığıMm, TaşıyıcıSacKalınlığıMm
cluster = Cluster_8()
int = Integer(dejson.BasamakDağılımıTürü)
int_2 = Integer(dejson.TaşıyıcıKalınlığıCm)
int_3 = Integer(dejson.TaşıyıcıDurum)
int_4 = Integer(dejson.CamDurum)
int_5 = Integer(dejson.TaşıyıcıTipi)
int_6 = Integer(dejson.CidarTipi)
int_7 = Integer(dejson.TaşıyıcıCamKalınlığıMm)
int_8 = Integer(dejson.TaşıyıcıSacKalınlığıMm)
cut_points_0 = RemoteSender()
cut_points_0_2 = RemoteReceiver(cut_points_0)
beam_booleaan = RemoteSender(int_3)
beam_type = RemoteSender(int_5)
beam_type_2 = RemoteReceiver(beam_type)
beam_type_3 = RemoteReceiver(beam_type)
beam_width = RemoteSender(int_2)
beam_width_2 = RemoteReceiver(beam_width)
cluster_2 = Cluster_11(
    curve=curve_3,
    step_curve=riser_curve_3,
    beam_width=beam_width_2,
    type=type_4,
    beam_type=beam_type_2,
    all_values_json=all_values_json_3)  # -> flow_curve_0_final_3, flow_curve_1_final_3, cut_points_1_3
flow_curve_0_final = RemoteSender(cluster_2.flow_curve_0_final_3)
flow_curve_1_final = RemoteSender(cluster_2.flow_curve_1_final_3)
cut_points_1 = RemoteSender(cluster_2.cut_points_1_3)
beam_width_3 = RemoteReceiver(beam_width)
glass_width = RemoteSender(int_7)
riserdistribution = RemoteSender(int)
riserdistribution_2 = RemoteReceiver(riserdistribution)
cluster_3 = Cluster_2(
    flow_curve_0=flow_curve_0_2,
    flow_curve_1=flow_curve_1,
    cut_points_0=cut_points_0_2,
    beam_type=beam_type_3,
    beam_width=beam_width_3,
    riserdistribution=riserdistribution_2)  # -> flow_curve_0_final_3, flow_curve_1_final_4, cut_points_1_3
glass_boolean = RemoteSender(int_4)
sheet_thickness = RemoteSender(int_8)
no_wall = RemoteSender(int_6)
surface_to_flow_3 = RemoteReceiver(surface_to_flow_2)
sheet_thickness_2 = RemoteReceiver(sheet_thickness)
cut_points_1_2 = RemoteReceiver(cut_points_1)
cluster_4 = Cluster(surface_to_flow=surface_to_flow_3, cut_points_1=cut_points_1_2)
sorted_flow_surface = RemoteSender(cluster_4)
no_wall_2 = RemoteReceiver(no_wall)
sorted_flow_surface_2 = RemoteReceiver(sorted_flow_surface)
bool = Boolean(no_wall_2)
gate = StreamGate(Stream=sorted_flow_surface_2, Gate=bool)  # -> Target0, Target1
spine_width = RemoteReceiver()
flow_curve_1_final_2 = RemoteReceiver(flow_curve_1_final)
flow_curve_0_final_2 = RemoteReceiver(flow_curve_0_final)
flow_curve_0_final_3 = RemoteReceiver(flow_curve_0_final)
flow_curve_1_final_3 = RemoteReceiver(flow_curve_1_final)
sheet_thickness_3 = RemoteReceiver(sheet_thickness)
beam_width_4 = RemoteReceiver(beam_width)
beam_width_5 = RemoteReceiver(beam_width)
cluster_5 = Cluster_6(
    flow_surface=gate.Target0,
    beam_width=beam_width_5,
    flow_curve_0_final=flow_curve_0_final_3,
    flow_curve_1_final=flow_curve_1_final_3)
cluster_6 = Cluster_5(
    sorted_flow_surface=gate.Target1,
    flow_curve_0_final=flow_curve_0_final_2,
    flow_curve_1_final=flow_curve_1_final_2,
    support_width=beam_width_4,
    support_sheet_thickness=sheet_thickness_3)
beam = RemoteSender(cluster_5)
beam_2 = RemoteSender(cluster_6)
beam_3 = RemoteReceiver([beam_2, beam])
beam_4 = ClusterOutput(beam_3)

# ==== cluster Cluster_13
panel = Panel("""Taşıyıcı A Kalınlığı (cm)
Zigzag A Üst Pay (cm)
Zigzag A Alt Pay (cm)""")
panel_2 = Panel("""Taşıyıcı B Kalınlığı (cm)
Zigzag B Üst Pay (cm)
Zigzag B Alt Pay (cm)""")
riser_curve = ClusterInput()
riser_vector = ClusterInput()
curve = ClusterInput()
type = ClusterInput()
all_values_json = ClusterInput()
riser_vector_2 = RemoteSender(riser_vector)
riser_curve_2 = RemoteSender(riser_curve)
curve_2 = RemoteSender(curve)
type_2 = RemoteSender(type)
inner_bool = RemoteSender(Slider(0, range=0..1))
# Taşıyıcı A Durum
# Cam A Durum
# Taşıyıcı Tipi A
# Cidar Tipi A
# Taşıyıcı A Kalınlığı (cm)
# Taşıyıcı A Cam Kalınlığı (mm)
# Taşıyıcı A Sac Kalınlığı (mm)
all_values_json_2 = RemoteSender(all_values_json)
riser_vector_3 = RemoteReceiver(riser_vector_2)
riser_curve_3 = RemoteReceiver(riser_curve_2)
type_3 = RemoteReceiver(type_2)
_2 = Integer(2)
move = Move(Geometry=riser_curve_3, Motion=riser_vector_3)  # -> Geometry, Transform
addition = Addition(A=type_3, B=_2)
type_4 = RemoteReceiver(type_2)
all_values_json_3 = RemoteReceiver(all_values_json_2)
item = ListItem(List=move.Geometry, Index=addition, Wrap=True)
# Taşıyıcı B Durum
# Cam B Durum
# Taşıyıcı Tipi B
# Cidar Tipi B
# Taşıyıcı B Kalınlığı (cm)
# Taşıyıcı B Cam Kalınlığı (mm)
# Taşıyıcı B Sac Kalınlığı (mm)
type_5 = RemoteReceiver(type_2)
filter = StreamFilter(Gate=type_4, Stream0=" A", Stream1=" B")
filter_2 = StreamFilter(Gate=type_5, Stream0=panel, Stream1=panel_2)
dejsonkv = DeserializeKeysAndValues(JSON=all_values_json_3, Keys=filter_2)  # -> Key, Value
rep = ReplaceText(Text=dejsonkv.Key, Find=filter, Replace=" ", RecursiveReplace=False)
riser_vector_4 = RemoteReceiver(riser_vector_2)
_0 = Integer(0)
riser_curve_4 = RemoteReceiver(riser_curve_2)
move_2 = Move(Geometry=riser_curve_4, Motion=riser_vector_4)  # -> Geometry, Transform
rejsonkv = SerializeKeysAndValues(Key=rep, Value=dejsonkv.Value)
join = JoinCurves(Curves=move_2.Geometry, Preserve=False)
dejson = DeserializeJson(JSON=rejsonkv, OutputsLocked=False)  # -> TaşıyıcıKalınlığıCm, ZigzagÜstPayCm, ZigzagLtPayCm
int = Integer(dejson.TaşıyıcıKalınlığıCm)
int_2 = Integer(dejson.ZigzagÜstPayCm)
int_3 = Integer(dejson.ZigzagLtPayCm)
beam_width = RemoteSender(int)
beam_width_2 = RemoteReceiver(beam_width)
neg = Negative(Value=beam_width_2)
offcrv = OffsetCurve(Curve=item, Plane=PlaneXY(0, 0, 0), Distance=beam_width_2, BothSides=neg, Kinks=0, CapType=_0)
midpt = CurveMiddle(Curve=offcrv)
srf_cp = SurfaceClosestPoint(Point=midpt, Surface=join)  # -> Point, UVPoint, Distance
sort = SortList(Keys=srf_cp.Distance, ValuesA=offcrv)  # -> Keys, reverse(ValuesA)
move_up = RemoteSender(int_2)
move_down = RemoteSender(int_3)
item_2 = ListItem(List=sort.ValuesA, Index=0, Wrap=True)
selected_riser_curve = RemoteSender(item_2)
beam_width_3 = RemoteReceiver(beam_width)
riser_curve_5 = RemoteReceiver(riser_curve_2)
curve_3 = RemoteReceiver(curve_2)
boundary = BoundarySurfaces(Edges=riser_curve_5)  # -> flatten(Surfaces)
neg_2 = Negative(Value=beam_width_3)
offcrv_2 = OffsetCurve(Curve=curve_3, Plane=PlaneXY(0, 0, 0), Distance=beam_width_3, BothSides=neg_2, Kinks=0, CapType=_0)
sunion = SolidUnion(Breps=boundary)
integer = Integer(-1)
midpt_2 = CurveMiddle(Curve=offcrv_2)
srf_cp_2 = SurfaceClosestPoint(Point=midpt_2, Surface=sunion)  # -> Point, UVPoint, Distance
_0_2 = Integer(0)
sort_2 = SortList(Keys=srf_cp_2.Distance, ValuesA=offcrv_2)  # -> Keys, ValuesA
item_3 = ListItem(List=reverse(sort_2.ValuesA), Index=0, Wrap=True)
flow_curve_0 = RemoteSender(item_3)
flow_curve_0_2 = RemoteReceiver(flow_curve_0)
len = Length(Curve=flow_curve_0_2)  # -> flatten(Length)
ma = MassAddition(Input=len)  # -> Result, PartialResults
cull_i = CullIndex(List=flatten(ma.PartialResults), Indices=integer, Wrap=True)
flow_curve_0_3 = RemoteReceiver(flatten(flow_curve_0))
merge = Merge(Data1=flatten(_0_2), Data2=flatten(cull_i))
end = EndPoints(Curve=flow_curve_0_3)  # -> Start, End
merge_2 = Merge(Data1=end.Start, Data2=end.End)
cullpt = CullDuplicates(Points=flatten(merge_2), Tolerance=0.1, CullMode=1)  # -> Points, Indices, Valence
pt = ConstructPoint(XCoordinate=merge, YCoordinate=0, ZCoordinate=0)
pt_2 = ConstructPoint(XCoordinate=ma.PartialResults, YCoordinate=0, ZCoordinate=0)
flow_curve_0_4 = RemoteReceiver(flow_curve_0)
cut_points_0 = RemoteSender(cullpt.Points)
join_2 = JoinCurves(Curves=flatten(flow_curve_0_4), Preserve=False)
ln = Line(StartPoint=pt, EndPoint=pt_2)
flow_curve_1 = RemoteSender(ln)
flow_curve_1_2 = RemoteReceiver(flow_curve_1)
join_3 = JoinCurves(Curves=flatten(flow_curve_1_2), Preserve=False)
cut_points_0_2 = RemoteReceiver(cut_points_0)
selected_riser_curve_2 = RemoteReceiver(selected_riser_curve)
flow_curve_0_5 = RemoteReceiver(flow_curve_0)
flow_curve_1_3 = RemoteReceiver(flow_curve_1)
flow = Flow(
    Geometry=cut_points_0_2,
    Base=join_2,
    Target=graft(join_3),
    ReverseBase=False,
    ReverseTarget=False,
    Stretch=True,
    Rigid=False)  # -> flatten(Geometry)
flow_2 = Flow(
    Geometry=selected_riser_curve_2,
    Base=graft(flow_curve_0_5),
    Target=graft(flow_curve_1_3),
    ReverseBase=False,
    ReverseTarget=False,
    Stretch=True,
    Rigid=False)  # -> flatten(Geometry)
cut_points_1 = RemoteSender(flow)
flowed_step_curve = RemoteSender(flow_2)
flowed_step_curve_2 = RemoteReceiver(flowed_step_curve)
end_2 = EndPoints(Curve=flatten(flowed_step_curve_2))  # -> Start, End
integer_2 = Integer(-1)
_0_3 = Integer(0)
cull_i_2 = CullIndex(List=flatten(end_2.End), Indices=integer_2, Wrap=True)
cull_i_3 = CullIndex(List=flatten(end_2.Start), Indices=_0_3, Wrap=True)
flowed_step_curve_3 = RemoteReceiver(flowed_step_curve)
ln_2 = Line(StartPoint=cull_i_2, EndPoint=cull_i_3)  # -> graft(Line)
merge_3 = Merge(Data1=simplify(flowed_step_curve_3), Data2=simplify(ln_2))
join_4 = JoinCurves(Curves=flatten(merge_3), Preserve=False)
explode = Explode(Curve=join_4, Recursive=True)  # -> Segments, Vertices
pline = PolyLine(Vertices=explode.Vertices, Closed=False)  # -> flatten(Polyline)
join_5 = JoinCurves(Curves=pline, Preserve=False)
_2_2 = Integer(2)
_100000 = Integer(100000)
move_down_2 = RemoteReceiver(move_down)
division = Division(A=_100000, B=_2_2)
neg_3 = Negative(Value=move_down_2)
move_up_2 = RemoteReceiver(move_up)
neg_4 = Negative(Value=division)
vec = VectorXYZ(XComponent=move_up_2, YComponent=0, ZComponent=move_up_2)  # -> Vector, Length
vec_2 = VectorXYZ(XComponent=neg_3, YComponent=0, ZComponent=neg_3)  # -> Vector, Length
Z = UnitZ(Factor=neg_4)
cut_points_1_2 = RemoteReceiver(cut_points_1)
panel_3 = Panel("""-1
0""")
move_3 = Move(Geometry=join_5, Motion=vec.Vector)  # -> Geometry, Transform
move_4 = Move(Geometry=join_5, Motion=vec_2.Vector)  # -> Geometry, Transform
item_4 = ListItem(List=cut_points_1_2, Index=panel_3, Wrap=True)
move_5 = Move(Geometry=item_4, Motion=Z)  # -> Geometry, Transform
Z_2 = UnitZ(Factor=1)
_100000_2 = Integer(100000)
merge_4 = Merge(Data1=move_3.Geometry, Data2=move_4.Geometry)
ext = ExtendCurve(Curve=merge_4, Type=0, Start=_100000_2, End=_100000_2)
line = LineSDL(Start=move_5.Geometry, Direction=Z_2, Length=_100000_2)
ccx = CurveCurve(CurveA=simplify(graft(ext)), CurveB=line)  # -> Points, ParamsA, ParamsB
cut_points_1_3 = RemoteReceiver(cut_points_1)
Z_3 = UnitZ(Factor=1)
_100000_3 = Integer(100000)
pshift = ShiftPaths(Data=ccx.Points, Offset=-1)
line_2 = LineSDL(Start=cut_points_1_3, Direction=Z_3, Length=_100000_3)
ptstrimcrv = PointsTrimCurve(Curve=graft(ext), Points=pshift, Flip=invert(False))  # -> Trimmed, SubDomains, Intersected
_2_3 = Integer(2)
end_3 = EndPoints(Curve=ptstrimcrv.Trimmed)  # -> Start, End
move_6 = Move(Motion=Vector(0, 0, 10))  # -> Geometry, Transform
division_2 = Division(A=_100000_3, B=_2_3)
pline_2 = PolyLine(Vertices=flatten(end_3.Start), Closed=False)
pline_3 = PolyLine(Vertices=flatten(end_3.End), Closed=False)
neg_5 = Negative(Value=division_2)
Z_4 = UnitZ(Factor=neg_5)
merge_5 = Merge(Data1=pline_2, Data2=pline_3, Data3=ptstrimcrv.Trimmed)  # -> flatten(Result)
move_7 = Move(Geometry=line_2, Motion=Z_4)  # -> Geometry, Transform
join_6 = JoinCurves(Curves=merge_5, Preserve=False)
boundary_2 = BoundarySurfaces(Edges=join_6)
srfsplit = SurfaceSplit(Surface=boundary_2, Curves=move_7.Geometry)
midpt_3 = CurveMiddle(Curve=srfsplit)
flow_curve_1_4 = RemoteReceiver(flatten(flow_curve_1))
flow_curve_0_6 = RemoteReceiver(flatten(flow_curve_0))
pdecon = Deconstruct(Point=midpt_3)  # -> XComponent, YComponent, ZComponent
sort_3 = SortList(Keys=pdecon.ZComponent, ValuesA=srfsplit)  # -> Keys, reverse(ValuesA)
flow_3 = Flow(
    Geometry=simplify(graft(sort_3.ValuesA)),
    Base=simplify(graft(flow_curve_1_4)),
    Target=graft(flow_curve_0_6),
    ReverseBase=False,
    ReverseTarget=False,
    Stretch=True,
    Rigid=False)
beam_width_4 = RemoteReceiver(beam_width)
join_7 = BrepJoin(Breps=flatten(flow_3))  # -> Breps, Closed
type_6 = RemoteReceiver(type_2)
neg_6 = Negative(Value=beam_width_4)
filter_3 = StreamFilter(Gate=type_6, Stream0=neg_6, Stream1=beam_width_4)
offsrf = OffsetSurface(Surface=join_7.Breps, Distance=filter_3, BothSides=0, CreateSolid=True)
join_8 = BrepJoin(Breps=offsrf)  # -> Breps, Closed
sunion_2 = SolidUnion(Breps=join_8.Breps)
fmerge = MergeFaces(Brep=sunion_2)  # -> Breps, Before, After
shape = RemoteSender(fmerge.Breps)
shape_2 = ClusterOutput(shape)

# ==== cluster Cluster
surface_to_flow = ClusterInput()
cut_points_1 = ClusterInput()
cut_points_1_2 = RemoteSender(cut_points_1)
surface_to_flow_2 = RemoteSender(surface_to_flow)
surface_to_flow_3 = RemoteReceiver(surface_to_flow_2)
xz = XZPlane(Origin=Point(0, 0, 0))
project = Project(Geometry=surface_to_flow_3, Plane=xz)  # -> Geometry, Transform
boundary = BoundarySurfaces(Edges=project.Geometry)
Z = UnitZ(Factor=1)
edges = BrepEdges(Brep=boundary)  # -> Naked, Interior, NonManifold
edgesdir = EdgesFromDirections(Brep=boundary, Directions=Z, Reflex=True, Angle=0)  # -> Edges, Indices, Map
cull_i = CullIndex(List=edges.Naked, Indices=edgesdir.Indices, Wrap=True)
join = JoinCurves(Curves=cull_i, Preserve=False)
midpt = CurveMiddle(Curve=join)
pdecon = Deconstruct(Point=midpt)  # -> XComponent, YComponent, ZComponent
sort = SortList(Keys=pdecon.ZComponent, ValuesA=join)  # -> Keys, ValuesA
item = ListItem(List=sort.ValuesA, Index=0, Wrap=True)
end = EndPoints(Curve=item)  # -> Start, End
pdecon_2 = Deconstruct(Point=end.Start)  # -> XComponent, YComponent, ZComponent
pdecon_3 = Deconstruct(Point=end.End)  # -> XComponent, YComponent, ZComponent
larger = LargerThan(FirstNumber=pdecon_2.XComponent, SecondNumber=pdecon_3.XComponent)  # -> LargerThan, OrEqualTo
dispatch = Dispatch(List=simplify(graft(boundary)), DispatchPattern=simplify(larger.LargerThan))  # -> ListA, ListB
flip = Flip(Surface=dispatch.ListA)  # -> Surface, Result
merge = Merge(Data1=flip.Surface, Data2=dispatch.ListB)
_1 = Integer(1)
shfdep = ShiftToDepth(Tree=merge, Depth=_1, shiftFromStart=False)
center = Center(Geometry=shfdep)  # -> Center, Dimension
pdecon_4 = Deconstruct(Point=center.Center)  # -> XComponent, YComponent, ZComponent
_1_2 = Integer(1)
cut_points_1_3 = RemoteReceiver(flatten(cut_points_1_2))
shfdep_2 = ShiftToDepth(Tree=pdecon_4.XComponent, Depth=_1_2, shiftFromStart=False)
_5000 = Integer(5000)
neg = Negative(Value=_5000)
sort_2 = SortList(Keys=shfdep_2, ValuesA=shfdep)  # -> Keys, reverse(flatten(ValuesA))
Z_2 = UnitZ(Factor=neg)
cullpt = CullDuplicates(Points=cut_points_1_3, Tolerance=0.1, CullMode=1)  # -> Points, Indices, Valence
panel = Panel("""-1
0""")
cull_i_2 = CullIndex(List=cullpt.Points, Indices=panel, Wrap=True)
move = Move(Geometry=cullpt.Points, Motion=Z_2)  # -> Geometry, Transform
_30000 = Integer(30000)
line = LineSDL(Start=move.Geometry, Direction=Vector(0, 0, 1), Length=_30000)
srfsplit = SurfaceSplit(Surface=sort_2.ValuesA, Curves=line)  # -> flatten(Fragments)
evalsrf = EvaluateSurface(Surface=reparameterize(srfsplit), Point="0.5,0.5")  # -> Point, Normal, UDirection, VDirection, Frame
center_2 = Center(Geometry=srfsplit)  # -> Center, Dimension
pdecon_5 = Deconstruct(Point=center_2.Center)  # -> XComponent, YComponent, ZComponent
sort_3 = SortList(Keys=pdecon_5.XComponent, ValuesA=srfsplit)  # -> Keys, ValuesA
explode = Explode(Curve=simplify(graft(sort_3.ValuesA)), Recursive=True)  # -> Segments, Vertices
cullpt_2 = CullDuplicates(Points=explode.Vertices, Tolerance=0.1, CullMode=1)  # -> Points, Indices, Valence
pdecon_6 = Deconstruct(Point=cullpt_2.Points)  # -> XComponent, YComponent, ZComponent
sort_4 = SortList(Keys=pdecon_6.ZComponent, ValuesA=cullpt_2.Points)  # -> Keys, ValuesA
panel_2 = Panel("""0
1""")
sorted_flow_surface = RemoteSender(sort_3.ValuesA)
item_2 = ListItem(List=sort_4.ValuesA, Index=panel_2, Wrap=True)
pdecon_7 = Deconstruct(Point=item_2)  # -> XComponent, YComponent, ZComponent
cut_points_1_4 = RemoteReceiver(cut_points_1_2)
sort_5 = SortList(Keys=pdecon_7.XComponent, ValuesA=item_2)  # -> Keys, ValuesA
item_3 = ListItem(List=cut_points_1_4, Index=0, Wrap=True)
item_4 = ListItem(List=sort_5.ValuesA, Index=0, Wrap=True)
crv_cp = CurveClosestPoint(Point=item_3, Curve=graft(sort_3.ValuesA))  # -> Point, Parameter, Distance
seam = Seam(Curve=graft(sort_3.ValuesA), Seam=crv_cp.Parameter)
boundary_2 = BoundarySurfaces(Edges=seam)
sorted_flow_surface_2 = RemoteReceiver(sorted_flow_surface)
sorted_flow_surface_3 = ClusterOutput(sorted_flow_surface_2)

# ==== cluster Cluster_2
flow_curve_0 = ClusterInput()
flow_curve_1 = ClusterInput()
cut_points_0 = ClusterInput()
beam_type = ClusterInput()
beam_width = ClusterInput()
riserdistribution = ClusterInput()
flow_curve_0_2 = RemoteSender(flow_curve_0)
flow_curve_1_2 = RemoteSender(flow_curve_1)
cut_points_0_2 = RemoteSender(cut_points_0)
beam_width_2 = RemoteSender(beam_width)
beam_type_2 = RemoteSender(beam_type)
riserdistribution_2 = RemoteSender(riserdistribution)
flow_curve_0_3 = RemoteReceiver(flow_curve_0_2)
cut_points_0_3 = RemoteReceiver(cut_points_0_2)
join = JoinCurves(Curves=flatten(flow_curve_0_3), Preserve=False)
crv_cp = CurveClosestPoint(Point=cut_points_0_3, Curve=join)  # -> Point, Parameter, Distance
shatter = Shatter(Curve=join, Parameters=crv_cp.Parameter)
panel = Panel("""-1
0""")
beam_width_3 = RemoteReceiver(beam_width_2)
_2 = Integer(2)
item = ListItem(List=shatter, Index=0, Wrap=True)
cull_i = CullIndex(List=shatter, Indices=panel, Wrap=True)
item_2 = ListItem(List=shatter, Index=0, Wrap=True)  # -> Item1, Item
beam_width_4 = RemoteReceiver(beam_width_2)
beam_width_5 = RemoteReceiver(beam_width_2)
division = Division(A=beam_width_3, B=_2)
neg = Negative(Value=division)
neg_2 = Negative(Value=division)
_0 = Integer(0)
_0_2 = Integer(0)
ext = ExtendCurve(Curve=item, Type=0, Start=_0, End=division)
ext_2 = ExtendCurve(Curve=cull_i, Type=0, Start=neg_2, End=division)
ext_3 = ExtendCurve(Curve=item_2.Item1, Type=0, Start=neg, End=_0_2)
flow_curve_1_3 = RemoteReceiver(flow_curve_1_2)
entwine = Entwine(Branch00=ext, Branch01=ext_2, Branch02=ext_3, FlattenInputs=True)  # -> flatten(Result)
beam_type_3 = RemoteReceiver(beam_type_2)
_2_2 = Integer(2)
flow_curve_0_4 = RemoteReceiver(flow_curve_0_2)
join_2 = JoinCurves(Curves=flatten(flow_curve_1_3), Preserve=False)
equals = Equality(FirstNumber=beam_type_3, SecondNumber=_2_2)  # -> Equality, Inequality
len = Length(Curve=entwine)  # -> flatten(Length)
join_3 = JoinCurves(Curves=flatten(flow_curve_0_4), Preserve=False)
len_2 = Length(Curve=join_2)
riserdistribution_3 = RemoteReceiver(riserdistribution_2)
flow_curve_0_5 = RemoteReceiver(flow_curve_0_2)
filter = StreamFilter(Gate=equals.Equality, Stream0=entwine, Stream1=join_3)
cull_i_2 = CullIndex(List=len, Indices="-1", Wrap=True)
crvdom = CurveDomain(Curve=join_2, Domain=len_2)  # -> Curve, Domain
flow_curve_1_4 = RemoteReceiver(flow_curve_1_2)
beam_type_4 = RemoteReceiver(beam_type_2)
_2_3 = Integer(2)
ma = MassAddition(Input=cull_i_2)  # -> Result, PartialResults
join_4 = JoinCurves(Curves=flatten(flow_curve_1_4), Preserve=False)
filter_2 = StreamFilter(Gate=riserdistribution_3, Stream0=flow_curve_0_5, Stream1=filter, Stream2=filter, Stream3=filter)
equals_2 = Equality(FirstNumber=beam_type_4, SecondNumber=_2_3)  # -> Equality, Inequality
shatter_2 = Shatter(Curve=crvdom.Curve, Parameters=ma.PartialResults)  # -> flatten(Segments)
riserdistribution_4 = RemoteReceiver(riserdistribution_2)
flow_curve_1_5 = RemoteReceiver(flow_curve_1_2)
flow_curve_0_final = RemoteSender(filter_2)
filter_3 = StreamFilter(Gate=equals_2.Equality, Stream0=shatter_2, Stream1=join_4)
filter_4 = StreamFilter(Gate=riserdistribution_4, Stream0=flow_curve_1_5, Stream1=filter_3, Stream2=filter_3, Stream3=filter_3)
flow_curve_1_final = RemoteSender(filter_4)
flow_curve_1_final_2 = RemoteReceiver(flow_curve_1_final)
end = EndPoints(Curve=flatten(flow_curve_1_final_2))  # -> Start, End
merge = Merge(Data1=end.Start, Data2=end.End)
cullpt = CullDuplicates(Points=merge, Tolerance=0.1, CullMode=2)  # -> Points, Indices, Valence
flow_curve_0_final_2 = RemoteReceiver(flow_curve_0_final)
flow_curve_1_final_3 = RemoteReceiver(flow_curve_1_final)
cull_i_3 = CullIndex(List=merge, Indices=cullpt.Indices, Wrap=True)
cullpt_2 = CullDuplicates(Points=cull_i_3, Tolerance=0.1, CullMode=1)  # -> Points, Indices, Valence
flow_curve_0_final_3 = ClusterOutput(flow_curve_0_final_2)
flow_curve_1_final_4 = ClusterOutput(flow_curve_1_final_3)
cut_points_1 = RemoteSender(cullpt_2.Points)
cut_points_1_2 = RemoteReceiver(cut_points_1)
cut_points_1_3 = ClusterOutput(cut_points_1_2)

# ==== cluster Cluster_5
support_sheet_thickness = ClusterInput()
sorted_flow_surface = ClusterInput()
flow_curve_0_final = ClusterInput()
flow_curve_1_final = ClusterInput()
support_width = ClusterInput()
support_sheet_thickness_2 = RemoteSender(support_sheet_thickness)
sorted_flow_surface_2 = RemoteSender(sorted_flow_surface)
flow_curve_0_final_2 = RemoteSender(flow_curve_0_final)
flow_curve_1_final_2 = RemoteSender(flow_curve_1_final)
support_width_2 = RemoteSender(support_width)
flow_curve_0_final_3 = RemoteReceiver(flow_curve_0_final_2)
lng = ListLength(List=flow_curve_0_final_3)
_1 = Integer(1)
sorted_flow_surface_3 = RemoteReceiver(sorted_flow_surface_2)
support_sheet_thickness_3 = RemoteReceiver(support_sheet_thickness_2)
equals = Equality(FirstNumber=lng, SecondNumber=_1)  # -> Equality, Inequality
flow_curve_0_final_4 = RemoteReceiver(flow_curve_0_final_2)
flow_curve_1_final_3 = RemoteReceiver(flow_curve_1_final_2)
support_width_3 = RemoteReceiver(support_width_2)
support_sheet_thickness_4 = RemoteReceiver(support_sheet_thickness_2)
sorted_flow_surface_4 = RemoteReceiver(sorted_flow_surface_2)
flow_curve_0_final_5 = RemoteReceiver(flow_curve_0_final_2)
flow_curve_1_final_4 = RemoteReceiver(flow_curve_1_final_2)
support_width_4 = RemoteReceiver(support_width_2)
gate = StreamGate(Stream=sorted_flow_surface_3, Gate=equals.Equality)  # -> Target0, Target1
cluster = Cluster_4(
    sorted_flow_surface=gate.Target0,
    flow_curve_0_final=flow_curve_0_final_5,
    flow_curve_1_final=flow_curve_1_final_4,
    support_width=support_width_4,
    support_sheet_thickness=support_sheet_thickness_4)
cluster_2 = Cluster_3(
    sorted_flow_surface=gate.Target1,
    flow_curve_0_final=flow_curve_0_final_4,
    flow_curve_1_final=flow_curve_1_final_3,
    support_width=support_width_3,
    support_sheet_thickness=support_sheet_thickness_3)
merge = Merge(Data1=cluster, Data2=cluster_2)
support = RemoteSender(merge)
support_2 = RemoteReceiver(support)
support_3 = ClusterOutput(support_2)
support_width_5 = RemoteReceiver(support_width_2)  # disabled
support_width_6 = RemoteReceiver(support_width_2)  # disabled
support_width_7 = RemoteReceiver(support_width_2)  # disabled
sorted_flow_surface_5 = RemoteReceiver(sorted_flow_surface_2)  # disabled
sorted_flow_surface_6 = RemoteReceiver(sorted_flow_surface_2)  # disabled
flow_curve_1_final_5 = RemoteReceiver(flow_curve_1_final_2)  # disabled
flow_curve_0_final_6 = RemoteReceiver(flow_curve_0_final_2)  # disabled
flow_curve_1_final_6 = RemoteReceiver(flow_curve_1_final_2)  # disabled
flow_curve_0_final_7 = RemoteReceiver(flow_curve_0_final_2)  # disabled
_2 = Integer(2)  # disabled
_2_2 = Integer(2)  # disabled
_2_3 = Integer(2)  # disabled
division = Division(A=support_width_5, B=_2)  # disabled
division_2 = Division(A=support_width_6, B=_2_2)  # disabled
division_3 = Division(A=support_width_7, B=_2_3)  # disabled
flow = Flow(
    Geometry=simplify(sorted_flow_surface_5),
    Base=simplify(flatten(flow_curve_1_final_5)),
    Target=simplify(flatten(flow_curve_0_final_6)),
    ReverseBase=False,
    ReverseTarget=False,
    Stretch=True,
    Rigid=False)  # disabled
neg = Negative(Value=division)  # disabled
flow_2 = Flow(
    Geometry=simplify(sorted_flow_surface_6),
    Base=simplify(flatten(flow_curve_1_final_6)),
    Target=simplify(flatten(flow_curve_0_final_7)),
    ReverseBase=False,
    ReverseTarget=False,
    Stretch=True,
    Rigid=False)  # disabled
neg_2 = Negative(Value=division_3)  # disabled
neg_3 = Negative(Value=division_2)  # disabled
offsrf = OffsetSurface(Surface=graft(flow), Distance=division, BothSides=neg, CreateSolid=True)  # disabled
offsrf_2 = OffsetSurface(Surface=graft(flow), Distance=division_2, BothSides=neg_3, CreateSolid=invert(True))  # disabled
offsrf_3 = OffsetSurface(Surface=graft(flow_2), Distance=division_3, BothSides=neg_2, CreateSolid=True)  # disabled
number_slider = Slider(1, range=0..1)  # disabled
support_sheet_thickness_5 = RemoteReceiver(support_sheet_thickness_2)  # disabled
debrep = DeconstructBrep(Brep=offsrf)  # -> Faces, Edges, Vertices; disabled
border = RemoteSender(offsrf)  # disabled
border_2 = RemoteSender(offsrf_3)  # disabled
panel = Panel("0.5,0.5")  # disabled
panel_2 = Panel("0.5,0.5")  # disabled
neg_4 = Negative(Value=support_sheet_thickness_5)  # disabled
number_slider_2 = Slider(1, range=0..1)  # disabled
evalsrf = EvaluateSurface(Surface=reparameterize(debrep.Faces), Point=panel_2)  # -> Point, Normal, UDirection, VDirection, Frame; disabled
offsrf_4 = OffsetSurface(Surface=graft(offsrf_2), Distance=support_sheet_thickness_5, BothSides=neg_4, CreateSolid=invert(True))  # -> simplify(Offset); disabled
shfdep = ShiftToDepth(Tree=offsrf_4, Depth=number_slider, shiftFromStart=False)  # disabled
evalsrf_2 = EvaluateSurface(Surface=reparameterize(shfdep), Point=panel)  # -> Point, Normal, UDirection, VDirection, Frame; disabled
panel_3 = Panel("0.5,0.5")  # disabled
border_3 = RemoteReceiver([border, border_2])  # disabled
number_slider_3 = Slider(1, range=0..1)  # disabled
evalsrf_3 = EvaluateSurface(Surface=reparameterize(offsrf_4), Point=panel_3)  # -> Point, Normal, UDirection, VDirection, Frame; disabled
shfdep_2 = ShiftToDepth(Tree=evalsrf_3.Point, Depth=number_slider_2, shiftFromStart=False)  # disabled
cullpt = CullDuplicates(Points=evalsrf_2.Point, Tolerance=0.1, CullMode=2)  # -> Points, Indices, Valence; disabled
brepinc = PointInBrep(Brep=simplify(border_3), Point=simplify(shfdep_2), Strict=False)  # disabled
item = ListItem(List=shfdep, Index=cullpt.Indices, Wrap=True)  # disabled
cull_i = CullIndex(List=shfdep, Indices=cullpt.Indices, Wrap=True)  # disabled
shfdep_3 = ShiftToDepth(Tree=offsrf_4, Depth=number_slider_3, shiftFromStart=False)  # disabled
dispatch = Dispatch(List=shfdep_3, DispatchPattern=brepinc)  # -> simplify(ListA), ListB; disabled
srf = Surface(dispatch.ListA)  # disabled
brep_cp = BrepClosestPoint(Point=evalsrf.Point, Brep=srf)  # -> Point, Normal, Distance; disabled
int = Integer(brep_cp.Distance)  # disabled
sort = SortList(Keys=int, ValuesA=debrep.Faces)  # -> Keys, ValuesA; disabled
area = Area(Geometry=debrep.Faces)  # -> Area, Centroid; disabled
cset = CreateSet(List=sort.Keys)  # -> Set, Map; disabled
sort_2 = SortList(Keys=area.Area, ValuesA=debrep.Faces)  # -> Keys, reverse(ValuesA); disabled
item_2 = ListItem(List=cset.Set, Index=0, Wrap=True)  # disabled
panel_4 = Panel("""0
1""")  # disabled
mindex = MemberIndex(Set=sort.Keys, Member=item_2)  # -> Index, Count; disabled
Z = UnitZ(Factor=1)  # disabled
Z_2 = UnitZ(Factor=1)  # disabled
item_3 = ListItem(List=sort_2.ValuesA, Index=reverse(panel_4), Wrap=True)  # disabled
edges = BrepEdges(Brep=srf)  # -> Naked, Interior, NonManifold; disabled
edgesdir = EdgesFromDirections(Brep=srf, Directions=Z, Reflex=True, Angle=0)  # -> Edges, Indices, Map; disabled
edges_2 = BrepEdges(Brep=dispatch.ListA)  # -> Naked, Interior, NonManifold; disabled
edgesdir_2 = EdgesFromDirections(Brep=dispatch.ListA, Directions=Z_2, Reflex=True, Angle=0)  # -> Edges, Indices, Map; disabled
item_4 = ListItem(List=sort.ValuesA, Index=mindex.Index, Wrap=True)  # disabled
panel_5 = Panel("0.5,0.5")  # disabled
flip = FlipMatrix(Data=edgesdir_2.Edges)  # disabled
cull_i_2 = CullIndex(List=edges.Naked, Indices=edgesdir.Indices, Wrap=True)  # disabled
evalsrf_4 = EvaluateSurface(Surface=reparameterize(item_3), Point=panel_5)  # -> Point, Normal, UDirection, VDirection, Frame; disabled
cull_i_3 = CullIndex(List=edges_2.Naked, Indices=edgesdir_2.Indices, Wrap=True)  # disabled
number_slider_4 = Slider(0, range=0..10)  # disabled
flip_2 = FlipMatrix(Data=cull_i_3)  # disabled
srf_2 = Surface(dispatch.ListA)  # disabled
srf_cp = SurfaceClosestPoint(Point=simplify(flatten(evalsrf_4.Frame)), Surface=graft(srf_2))  # -> Point, UVPoint, Distance; disabled
loft = Loft(Curves=flip, Options={Adjust=False, Closed=False, LoftEnds=0, LoftSimp=0, LoftType=0, Rebuild=10, Refit=0.01})  # disabled
loft_2 = Loft(Curves=flip_2, Options={Adjust=False, Closed=False, LoftEnds=0, LoftSimp=0, LoftType=0, Rebuild=10, Refit=0.01})  # disabled
_1_2 = Integer(1)  # disabled
sort_3 = SortList(Keys=srf_cp.Distance, ValuesA=flatten(item_3))  # -> Keys, ValuesA; disabled
shfdep_4 = ShiftToDepth(Tree=edgesdir.Edges, Depth=_1_2, shiftFromStart=False)  # disabled
support_sheet_thickness_6 = RemoteReceiver(support_sheet_thickness_2)  # disabled
support_sheet_thickness_7 = RemoteReceiver(support_sheet_thickness_2)  # disabled
join = JoinCurves(Curves=shfdep_4, Preserve=False)  # disabled
support_sheet_thickness_8 = RemoteReceiver(support_sheet_thickness_2)  # disabled
support_sheet_thickness_9 = RemoteReceiver(support_sheet_thickness_2)  # disabled
item_5 = ListItem(List=sort_3.ValuesA, Index=0, Wrap=True)  # disabled
merge_2 = Merge(Data1=simplify(graft(item_5)), Data2=graft(dispatch.ListA))  # disabled
branch = BranchByIndex(Tree=merge_2, Branch=number_slider_4)  # disabled
loft_3 = Loft(Curves=branch, Options={Adjust=False, Closed=False, LoftEnds=0, LoftSimp=0, LoftType=0, Rebuild=10, Refit=0.01})  # disabled
loft_4 = Loft(Curves=merge_2, Options={Adjust=False, Closed=False, LoftEnds=0, LoftSimp=0, LoftType=0, Rebuild=10, Refit=0.01})  # disabled
neg_5 = Negative(Value=support_sheet_thickness_6)  # disabled
neg_6 = Negative(Value=support_sheet_thickness_7)  # disabled
midpt = CurveMiddle(Curve=join)  # disabled
_1_3 = Integer(1)  # disabled
merge_3 = Merge(Data1=merge_2, Data2=loft_4)  # disabled
neg_7 = Negative(Value=support_sheet_thickness_8)  # disabled
neg_8 = Negative(Value=support_sheet_thickness_9)  # disabled
merge_4 = Merge(Data1=support_sheet_thickness_6, Data2=neg_5)  # disabled
merge_5 = Merge(Data1=support_sheet_thickness_7, Data2=neg_6)  # disabled
shfdep_5 = ShiftToDepth(Tree=cull_i_2, Depth=_1_3, shiftFromStart=False)  # disabled
pdecon = Deconstruct(Point=midpt)  # -> XComponent, YComponent, ZComponent; disabled
join_2 = BrepJoin(Breps=merge_3)  # -> Breps, Closed; disabled
merge_6 = Merge(Data1=support_sheet_thickness_8, Data2=neg_7)  # disabled
merge_7 = Merge(Data1=support_sheet_thickness_9, Data2=neg_8)  # disabled
offsrf_5 = OffsetSurface(Surface=graft(loft_2), Distance=merge_4, BothSides=0, CreateSolid=True)  # -> simplify(Offset); disabled
offsrf_6 = OffsetSurface(Surface=graft(loft_2), Distance=merge_5, BothSides=0, CreateSolid=invert(True))  # -> simplify(Offset); disabled
join_3 = JoinCurves(Curves=shfdep_5, Preserve=False)  # disabled
int_2 = Integer(pdecon.ZComponent)  # disabled
offsrf_7 = OffsetSurface(Surface=graft(loft), Distance=merge_6, BothSides=0, CreateSolid=True)  # -> simplify(Offset); disabled
offsrf_8 = OffsetSurface(Surface=graft(loft), Distance=merge_7, BothSides=0, CreateSolid=invert(True))  # -> simplify(Offset); disabled
midpt_2 = CurveMiddle(Curve=join_3)  # disabled
pshift = ShiftPaths(Data=offsrf_6, Offset=-1)  # disabled
panel_6 = Panel("0.5,0.5")  # disabled
number_slider_5 = Slider(1, range=0..1)  # disabled
pshift_2 = ShiftPaths(Data=offsrf_8, Offset=-1)  # disabled
panel_7 = Panel("0.5,0.5")  # disabled
sort_4 = SortList(Keys=int_2)  # -> Keys, ValuesA; disabled
evalsrf_5 = EvaluateSurface(Surface=reparameterize(pshift), Point=panel_6)  # -> Point, Normal, UDirection, VDirection, Frame; disabled
pdecon_2 = Deconstruct(Point=midpt_2)  # -> XComponent, YComponent, ZComponent; disabled
border_4 = RemoteReceiver([border, border_2])  # disabled
cset_2 = CreateSet(List=sort_4.Keys)  # -> Set, Map; disabled
evalsrf_6 = EvaluateSurface(Surface=reparameterize(pshift_2), Point=panel_7)  # -> Point, Normal, UDirection, VDirection, Frame; disabled
shfdep_6 = ShiftToDepth(Tree=join_2.Breps, Depth=number_slider_5, shiftFromStart=False)  # disabled
int_3 = Integer(pdecon_2.ZComponent)  # disabled
pshift_3 = ShiftPaths(Data=offsrf_5, Offset=-1)  # disabled
border_5 = RemoteReceiver([border, border_2])  # disabled
brepinc_2 = PointInBrep(Brep=border_4, Point=evalsrf_5.Point, Strict=False)  # disabled
int_4 = Integer(cset_2.Set)  # disabled
pshift_4 = ShiftPaths(Data=offsrf_7, Offset=-1)  # disabled
brepinc_3 = PointInBrep(Brep=border_5, Point=evalsrf_6.Point, Strict=False)  # disabled
dispatch_2 = Dispatch(List=pshift_3, DispatchPattern=brepinc_2)  # -> ListA, ListB; disabled
sort_5 = SortList(Keys=int_3)  # -> Keys, ValuesA; disabled
mindex_2 = MemberIndex(Set=int_2, Member=int_4)  # -> Index, Count; disabled
brep = Brep(dispatch_2.ListA)  # disabled
dispatch_3 = Dispatch(List=pshift_4, DispatchPattern=brepinc_3)  # -> ListA, ListB; disabled
cset_3 = CreateSet(List=sort_5.Keys)  # -> Set, Map; disabled
_1_4 = Integer(1)  # disabled
brep_2 = Brep(dispatch_3.ListA)  # disabled
shfdep_7 = ShiftToDepth(Tree=mindex_2.Index, Depth=_1_4, shiftFromStart=False)  # disabled
merge_8 = Merge(Data1=brep_2, Data2=brep)  # -> flatten(Result); disabled
int_5 = Integer(cset_3.Set)  # disabled
item_6 = ListItem(List=simplify(join), Index=simplify(shfdep_7), Wrap=True)  # disabled
mindex_3 = MemberIndex(Set=flatten(int_3), Member=int_5)  # -> Index, Count; disabled
sunion = SolidUnion(Breps=merge_8)  # disabled
fmerge = MergeFaces(Brep=sunion)  # -> Breps, Before, After; disabled
_2_4 = Integer(2)  # disabled
merge_9 = Merge(Data1=join_2.Breps, Data2=fmerge.Breps)  # -> flatten(Result); disabled
item_7 = ListItem(List=flatten(join_3), Index=mindex_3.Index, Wrap=True)  # disabled
partition = PartitionList(List=item_6, Size=_2_4)  # disabled
support_sheet_thickness_10 = RemoteReceiver(support_sheet_thickness_2)  # disabled
loft_5 = Loft(Curves=partition, Options={Adjust=False, Closed=False, LoftEnds=0, LoftSimp=0, LoftType=0, Rebuild=10, Refit=0.01})  # disabled
loft_6 = Loft(Curves=item_7, Options={Adjust=False, Closed=False, LoftEnds=0, LoftSimp=0, LoftType=0, Rebuild=10, Refit=0.01})  # disabled
_1_5 = Integer(1)  # disabled
support_sheet_thickness_11 = RemoteReceiver(support_sheet_thickness_2)  # disabled
_1_6 = Integer(1)  # disabled
shfdep_8 = ShiftToDepth(Tree=simplify(loft_6), Depth=_1_5, shiftFromStart=False)  # disabled
shfdep_9 = ShiftToDepth(Tree=simplify(loft_5), Depth=_1_6, shiftFromStart=False)  # disabled
neg_9 = Negative(Value=support_sheet_thickness_10)  # disabled
neg_10 = Negative(Value=support_sheet_thickness_11)  # disabled
entwine = Entwine(Branch00=support_sheet_thickness_11, Branch01=neg_10, FlattenInputs=True)  # disabled
entwine_2 = Entwine(Branch00=support_sheet_thickness_10, Branch01=neg_9, FlattenInputs=True)  # disabled
offsrf_9 = OffsetSurface(Surface=flatten(shfdep_8), Distance=simplify(entwine), BothSides=simplify(graft(0)), CreateSolid=True)  # -> simplify(Offset); disabled
offsrf_10 = OffsetSurface(Surface=flatten(shfdep_9), Distance=simplify(entwine_2), BothSides=simplify(graft(0)), CreateSolid=True)  # -> simplify(Offset); disabled
area_2 = Area(Geometry=offsrf_9)  # -> Area, Centroid; disabled
area_3 = Area(Geometry=offsrf_10)  # -> Area, Centroid; disabled
border_6 = RemoteReceiver([border, border_2])  # disabled
border_7 = RemoteReceiver([border, border_2])  # disabled
brepinc_4 = PointInBrep(Brep=simplify(border_6), Point=simplify(flatten(area_2.Centroid)), Strict=False)  # disabled
brepinc_5 = PointInBrep(Brep=simplify(border_7), Point=simplify(flatten(area_3.Centroid)), Strict=False)  # disabled
dispatch_4 = Dispatch(List=flatten(offsrf_9), DispatchPattern=brepinc_4)  # -> ListA, ListB; disabled
dispatch_5 = Dispatch(List=flatten(offsrf_10), DispatchPattern=brepinc_5)  # -> ListA, ListB; disabled
brep_3 = Brep(dispatch_4.ListA)  # disabled
brep_4 = Brep(dispatch_5.ListA)  # disabled
join_4 = BrepJoin(Breps=brep_3)  # -> Breps, Closed; disabled
join_5 = BrepJoin(Breps=brep_4)  # -> Breps, Closed; disabled
sunion_2 = SolidUnion(Breps=join_4.Breps)  # disabled
debrep_2 = DeconstructBrep(Brep=sunion_2)  # -> Faces, Edges, Vertices; disabled
_1_7 = Integer(1)  # disabled
sunion_3 = SolidUnion(Breps=join_5.Breps)  # disabled
shfdep_10 = ShiftToDepth(Tree=debrep_2.Faces, Depth=_1_7, shiftFromStart=False)  # disabled
join_6 = BrepJoin(Breps=shfdep_10)  # -> Breps, Closed; disabled
sdiff = SolidDifference(BrepsA=sunion_3, BrepsB=flatten(join_6.Breps))  # disabled
sdiff_2 = SolidDifference(BrepsA=join_6.Breps, BrepsB=flatten(sunion_3))  # disabled
area_4 = Area(Geometry=sdiff)  # -> Area, Centroid; disabled
area_5 = Area(Geometry=sdiff_2)  # -> Area, Centroid; disabled
border_8 = RemoteReceiver([border, border_2])  # disabled
border_9 = RemoteReceiver([border, border_2])  # disabled
brepinc_6 = PointInBrep(Brep=simplify(border_8), Point=simplify(area_4.Centroid), Strict=False)  # disabled
brepinc_7 = PointInBrep(Brep=simplify(border_9), Point=simplify(area_5.Centroid), Strict=False)  # disabled
dispatch_6 = Dispatch(List=sdiff, DispatchPattern=brepinc_6)  # -> ListA, ListB; disabled
dispatch_7 = Dispatch(List=sdiff_2, DispatchPattern=brepinc_7)  # -> ListA, ListB; disabled
brep_5 = Brep(dispatch_6.ListA)  # disabled
brep_6 = Brep(dispatch_7.ListA)  # disabled
merge_10 = Merge(Data1=simplify(shfdep_6), Data2=join_6.Breps, Data3=brep_5)  # -> graft(Result); disabled
trim = TrimSolid(Shape=sunion_3, Cutters=flatten(sunion_2))  # disabled
sdiff_3 = SolidDifference(BrepsA=graft(sunion_3), BrepsB=sunion_2)  # disabled
border_10 = RemoteReceiver([border, border_2])  # disabled
splitmul = SplitBrepMultiple(Brep=sunion_3, Cutters=sunion_2)  # disabled
splitmul_2 = SplitBrepMultiple(Brep=merge_10, Cutters=border_10)  # disabled
trim_2 = TrimSolid(Shape=merge_10, Cutters=flatten(border_10))  # disabled
area_6 = Area(Geometry=splitmul_2)  # -> Area, Centroid; disabled
area_7 = Area(Geometry=splitmul)  # -> Area, Centroid; disabled
area_8 = Area(Geometry=splitmul)  # -> Area, Centroid; disabled
sort_6 = SortList(Keys=area_6.Area, ValuesA=splitmul_2)  # -> Keys, ValuesA; disabled
item_8 = ListItem(List=reverse(sort_6.ValuesA), Index=0, Wrap=True)  # disabled
border_11 = RemoteReceiver([border, border_2])  # disabled
brepinc_8 = PointInBrep(Brep=simplify(border_11), Point=simplify(flatten(area_7.Centroid)), Strict=False)  # disabled
dispatch_8 = Dispatch(List=flatten(splitmul), DispatchPattern=brepinc_8)  # -> ListA, ListB; disabled
area_9 = Area(Geometry=dispatch_8.ListA)  # -> Area, Centroid; disabled
brepinc_9 = PointInBrep(Brep=simplify(sunion_2), Point=simplify(flatten(area_9.Centroid)), Strict=invert(False))  # disabled
not = GateNot(A=brepinc_9)  # disabled
dispatch_9 = Dispatch(List=flatten(dispatch_8.ListA), DispatchPattern=brepinc_9)  # -> ListA, ListB; disabled
brep_7 = Brep(dispatch_8.ListA)  # disabled
join_7 = BrepJoin(Breps=dispatch_8.ListA)  # -> Breps, Closed; disabled
sunion_4 = SolidUnion(Breps=join_7.Breps)  # disabled
capex = CapHolesEx(Brep=sunion_4)  # -> Brep, Caps, Solid; disabled

# ==== cluster Cluster_6
flow_curve_0_final = ClusterInput()
flow_curve_1_final = ClusterInput()
beam_width = ClusterInput()
flow_surface = ClusterInput()
flow_surface_2 = RemoteSender(flow_surface)
flow_curve_0_final_2 = RemoteSender(flow_curve_0_final)
flow_curve_1_final_2 = RemoteSender(flow_curve_1_final)
beam_width_2 = RemoteSender(beam_width)
flow_curve_1_final_3 = RemoteReceiver(flow_curve_1_final_2)
flow_curve_0_final_3 = RemoteReceiver(flow_curve_0_final_2)
flow_surface_3 = RemoteReceiver(flow_surface_2)
flow = Flow(
    Geometry=simplify(flow_surface_3),
    Base=simplify(flatten(flow_curve_1_final_3)),
    Target=simplify(flatten(flow_curve_0_final_3)),
    ReverseBase=False,
    ReverseTarget=False,
    Stretch=True,
    Rigid=False)
flowed_surface = RemoteSender(flow)
beam_width_3 = RemoteReceiver(beam_width_2)
glass_width = RemoteReceiver()
entwine = Entwine(Branch00=beam_width_3, Branch01=glass_width, FlattenInputs=True)
flowed_surface_2 = RemoteReceiver(flowed_surface)
division = Division(A=entwine, B=Slider(2, range=0..10))
lng = ListLength(List=flowed_surface_2)
repeat = RepeatData(Data=division, Length=lng)
flowed_surface_3 = RemoteReceiver(flowed_surface)
neg = Negative(Value=repeat)
offsrf = OffsetSurface(Surface=simplify(flowed_surface_3), Distance=flatten(repeat), BothSides=flatten(neg), CreateSolid=True)  # -> flatten(Offset)
join = BrepJoin(Breps=offsrf)  # -> Breps, Closed
sunion = SolidUnion(Breps=join.Breps)
fmerge = MergeFaces(Brep=sunion)  # -> Breps, Before, After
beam = RemoteSender(flatten(sunion))
beam_2 = ClusterOutput(beam)

# ==== cluster Cluster_8
genes = GenePool(Decimals=0, Maximum=300, Minimum=0, Value=[42, 109, 49])
step = ClusterInput()
seed = RemoteSender(Slider(0, range=0..1000))
row_no = RemoteSender(Slider(3, range=0..1000))
no_points = RemoteSender(Slider(300, range=0..1000))
max_depth = RemoteSender(Slider(300, range=0..1000))
step_2 = RemoteSender(step)
flow_curve_0 = ClusterInput()
flow_curve_1 = ClusterInput()
surface_to_flow = ClusterInput()
flow_curve_0_2 = RemoteReceiver(flow_curve_0)
move_vector = RemoteReceiver()
step_3 = RemoteReceiver(step_2)
flow_curve_1_2 = RemoteReceiver(flow_curve_1)
max_depth_2 = RemoteReceiver(max_depth)
surface_to_flow_2 = RemoteReceiver(surface_to_flow)
no_points_2 = RemoteReceiver(no_points)
seed_2 = RemoteReceiver(seed)
row_no_2 = RemoteReceiver(row_no)
cluster = Cluster_7(
    corner_lenght=max_depth_2,
    no_points=no_points_2,
    bake=Button(),
    flowcurve1=flow_curve_1_2,
    seed=seed_2,
    row_no=row_no_2,
    move_vector=genes,
    step=step_3,
    flow_curve_0=flow_curve_0_2,
    surface_to_flow=surface_to_flow_2)
boundary = BoundarySurfaces(Edges=step_3)
Y = UnitY(Factor=Slider(352, range=0..1000))
Y_2 = UnitY(Factor=Slider(151, range=0..1000))
extr = Extrude(Base=boundary, Direction=Y)
neg = Negative(Value=Y_2)
branch = BranchByIndex(Tree=cluster, Branch=Slider(1, range=0..1))
move = Move(Geometry=extr, Motion=neg)  # -> Geometry, Transform
points = RemoteReceiver()
xz = XZPlane(Origin=Point(0, 0, 0))
del = DelaunayMesh(Points=branch, Plane=xz)
msplit = MeshSplit(Mesh=del, Splitters=move.Geometry)
item = ListItem(List=msplit, Index=0, Wrap=True)
faceb = FaceBoundaries(Mesh=del)
flow_curve_0_3 = ClusterInput()
flow_curve_0_4 = ClusterInput()
flow_curve_1_3 = ClusterInput()
flow_curve_1_4 = ClusterInput()
flow_curve_0_5 = RemoteReceiver(flow_curve_0_3)
flow_curve_0_6 = RemoteReceiver(flow_curve_0_4)
flow_curve_1_5 = RemoteReceiver(flow_curve_1_3)
flow_curve_1_6 = RemoteReceiver(flow_curve_1_4)
points_2 = RemoteReceiver()
points_3 = RemoteReceiver()
flow = Flow(
    Geometry=item,
    Base=flow_curve_1_5,
    Target=flow_curve_0_5,
    ReverseBase=False,
    ReverseTarget=False,
    Stretch=invert(True),
    Rigid=False)
flow_2 = Flow(
    Geometry=move.Geometry,
    Base=flow_curve_1_6,
    Target=flow_curve_0_6,
    ReverseBase=False,
    ReverseTarget=False,
    Stretch=invert(True),
    Rigid=False)
points_4 = RemoteReceiver()
points_5 = PointList(Points=points_4, Size=Slider(57, range=0..100))
faceb_2 = FaceBoundaries(Mesh=flow)
boundary_2 = BoundarySurfaces(Edges=faceb_2)
tristian = RemoteSender(boundary_2)
tristian_2 = RemoteReceiver(tristian)
tristian_3 = ClusterOutput(tristian_2)

# ==== cluster Cluster_11
step_curve = ClusterInput()
type = ClusterInput()
beam_type = ClusterInput()
curve = ClusterInput()
beam_width = ClusterInput()
all_values_json = ClusterInput()
step_curve_2 = RemoteSender(step_curve)
beam_width_2 = RemoteSender(beam_width)
curve_2 = RemoteSender(curve)
step_curve_3 = RemoteReceiver(step_curve_2)
beam_type_2 = RemoteSender(beam_type)
type_2 = RemoteSender(type)
all_values_json_2 = RemoteSender(all_values_json)
join = JoinCurves(Curves=step_curve_3, Preserve=False)
all_values_json_3 = RemoteReceiver(all_values_json_2)
area = Area(Geometry=join)  # -> Area, Centroid
beam_width_3 = RemoteReceiver(beam_width_2)
dejsonkv = DeserializeKeysAndValues(JSON=all_values_json_3, Keys="Basamak Dağılımı Türü")  # -> Key, Value
pdecon = Deconstruct(Point=area.Centroid)  # -> XComponent, YComponent, ZComponent
_2 = Integer(2)
division = Division(A=beam_width_3, B=_2)
Z = UnitZ(Factor=pdecon.ZComponent)
neg = Negative(Value=Z)
rejsonkv = SerializeKeysAndValues(Key="Basamak Dağılımı Türü", Value=dejsonkv.Value)
neg_2 = Negative(Value=division)
_0 = Integer(0)
move = Move(Geometry=join, Motion=neg)  # -> flatten(Geometry), Transform
curve_3 = RemoteReceiver(curve_2)
dejson = DeserializeJson(JSON=rejsonkv, OutputsLocked=False)
offcrv = OffsetCurve(Curve=curve_3, Plane=PlaneXY(0, 0, 0), Distance=division, BothSides=neg_2, Kinks=0, CapType=_0)
sunion = SolidUnion(Breps=move.Geometry)
midpt = CurveMiddle(Curve=offcrv)
int = Integer(dejson)
riserdistribution = RemoteSender(int)
srf_cp = SurfaceClosestPoint(Point=midpt, Surface=sunion)  # -> Point, UVPoint, Distance
sort = SortList(Keys=srf_cp.Distance, ValuesA=offcrv)  # -> Keys, reverse(ValuesA)
item = ListItem(List=sort.ValuesA, Index=0, Wrap=True)
_1000 = Integer(1000)
ext = ExtendCurve(Curve=item, Type=0, Start=Slider(0, range=0..100), End=_1000)
number_slider = Slider(0, range=0..100)
riserdistribution_2 = RemoteReceiver(riserdistribution)
step_curve_4 = RemoteReceiver(step_curve_2)
filter = StreamFilter(Gate=riserdistribution_2, Stream0=step_curve_4, Stream1=ext, Stream2=ext, Stream3=ext)
flow_curve_0 = RemoteSender(graft(filter))
flow_curve_0_2 = RemoteReceiver(flow_curve_0)
len = Length(Curve=flatten(flow_curve_0_2))
flow_curve_0_3 = RemoteReceiver(flow_curve_0)
ma = MassAddition(Input=len)  # -> Result, PartialResults
integer = Integer(-1)
crvdeg = CurveDegree(Curve=flow_curve_0_3)
cull_i = CullIndex(List=ma.PartialResults, Indices=integer, Wrap=True)
_1 = Integer(1)
_0_2 = Integer(0)
larger = LargerThan(FirstNumber=crvdeg, SecondNumber=_1)  # -> LargerThan, OrEqualTo
entwine = Entwine(Branch00=_0_2, Branch01=cull_i, FlattenInputs=True)  # -> flatten(Result)
pt = ConstructPoint(XCoordinate=graft(entwine), YCoordinate=0, ZCoordinate=0)
pt_2 = ConstructPoint(XCoordinate=graft(ma.PartialResults), YCoordinate=0, ZCoordinate=0)
dispatch = Dispatch(List=flow_curve_0_3, DispatchPattern=larger.LargerThan)  # -> ListA, ListB
join_2 = JoinCurves(Curves=flatten(dispatch.ListB), Preserve=False)
ln = Line(StartPoint=pt, EndPoint=pt_2)
flow_curve_1 = RemoteSender(ln)
cluster = Cluster_9(curve=flatten(join_2))
explode = Explode(Curve=cluster, Recursive=True)  # -> Segments, Vertices
flow_curve_0_4 = RemoteReceiver(flow_curve_0)
join_3 = JoinCurves(Curves=flatten(flow_curve_0_4), Preserve=False)
end = EndPoints(Curve=join_3)  # -> Start, End
end_2 = EndPoints(Curve=join_3)  # -> Start, End
merge = Merge(Data1=explode.Vertices, Data2=end.Start, Data3=end.End, Data4=end_2.Start, Data5=end_2.End)  # -> flatten(Result)
cullpt = CullDuplicates(Points=merge, Tolerance=0.1, CullMode=2)  # -> Points, Indices, Valence
cut_points_0 = RemoteSender(cullpt.Points)
riserdistribution_3 = RemoteReceiver(riserdistribution)
flow_curve_0_5 = RemoteReceiver(flow_curve_0)
flow_curve_1_2 = RemoteReceiver(flow_curve_1)
cut_points_0_2 = RemoteReceiver(cut_points_0)
beam_width_4 = RemoteReceiver(beam_width_2)
beam_type_3 = RemoteReceiver(beam_type_2)
cluster_2 = Cluster_10(
    flow_curve_0=flow_curve_0_5,
    flow_curve_1=flow_curve_1_2,
    cut_points_0=cut_points_0_2,
    beam_type=beam_type_3,
    beam_width=beam_width_4,
    riserdistribution=riserdistribution_3)  # -> flow_curve_0_final_4, flow_curve_1_final_3, cut_points_1_3
flow_curve_0_final = RemoteSender(cluster_2.flow_curve_0_final_4)
flow_curve_1_final = RemoteSender(cluster_2.flow_curve_1_final_3)
cut_points_1 = RemoteSender(cluster_2.cut_points_1_3)
flow_curve_0_final_2 = RemoteReceiver(flow_curve_0_final)
flow_curve_1_final_2 = RemoteReceiver(flow_curve_1_final)
cut_points_1_2 = RemoteReceiver(cut_points_1)
flow_curve_0_final_3 = ClusterOutput(flow_curve_0_final_2)
flow_curve_1_final_3 = ClusterOutput(flow_curve_1_final_2)
cut_points_1_3 = ClusterOutput(cut_points_1_2)

# ==== cluster Cluster_3
number_slider = Slider(1, range=0..1)
support_sheet_thickness = ClusterInput()
sorted_flow_surface = ClusterInput()
flow_curve_0_final = ClusterInput()
flow_curve_1_final = ClusterInput()
support_width = ClusterInput()
support_sheet_thickness_2 = RemoteSender(support_sheet_thickness)
sorted_flow_surface_2 = RemoteSender(sorted_flow_surface)
flow_curve_0_final_2 = RemoteSender(flow_curve_0_final)
flow_curve_1_final_2 = RemoteSender(flow_curve_1_final)
support_width_2 = RemoteSender(support_width)
support_width_3 = RemoteReceiver(support_width_2)
support_width_4 = RemoteReceiver(support_width_2)
sorted_flow_surface_3 = RemoteReceiver(sorted_flow_surface_2)
flow_curve_1_final_3 = RemoteReceiver(flow_curve_1_final_2)
flow_curve_0_final_3 = RemoteReceiver(flow_curve_0_final_2)
_2 = Integer(2)
_2_2 = Integer(2)
division = Division(A=support_width_3, B=_2)
division_2 = Division(A=support_width_4, B=_2_2)
flow = Flow(
    Geometry=simplify(sorted_flow_surface_3),
    Base=simplify(flatten(flow_curve_1_final_3)),
    Target=simplify(flatten(flow_curve_0_final_3)),
    ReverseBase=False,
    ReverseTarget=False,
    Stretch=True,
    Rigid=False)
neg = Negative(Value=division)
neg_2 = Negative(Value=division_2)
offsrf = OffsetSurface(Surface=graft(flow), Distance=division, BothSides=neg, CreateSolid=True)
offsrf_2 = OffsetSurface(Surface=graft(flow), Distance=division_2, BothSides=neg_2, CreateSolid=invert(True))
support_sheet_thickness_3 = RemoteReceiver(support_sheet_thickness_2)
debrep = DeconstructBrep(Brep=offsrf)  # -> Faces, Edges, Vertices
border = RemoteSender(offsrf)
neg_3 = Negative(Value=support_sheet_thickness_3)
evalsrf = EvaluateSurface(Surface=reparameterize(debrep.Faces), Point="0.5,0.5")  # -> Point, Normal, UDirection, VDirection, Frame
offsrf_3 = OffsetSurface(Surface=graft(offsrf_2), Distance=support_sheet_thickness_3, BothSides=neg_3, CreateSolid=invert(True))  # -> simplify(Offset)
evalsrf_2 = EvaluateSurface(Surface=reparameterize(offsrf_3), Point="0.5,0.5")  # -> Point, Normal, UDirection, VDirection, Frame
_1 = Integer(1)
border_2 = RemoteReceiver(border)
shfdep = ShiftToDepth(Tree=evalsrf_2.Point, Depth=_1, shiftFromStart=False)
_1_2 = Integer(1)
brepinc = PointInBrep(Brep=simplify(border_2), Point=simplify(shfdep), Strict=False)
shfdep_2 = ShiftToDepth(Tree=offsrf_3, Depth=_1_2, shiftFromStart=False)
dispatch = Dispatch(List=shfdep_2, DispatchPattern=brepinc)  # -> simplify(ListA), ListB
area = Area(Geometry=debrep.Faces)  # -> Area, Centroid
sort = SortList(Keys=area.Area, ValuesA=debrep.Faces)  # -> Keys, reverse(ValuesA)
srf = Surface(dispatch.ListA)
brep_cp = BrepClosestPoint(Point=evalsrf.Point, Brep=srf)  # -> Point, Normal, Distance
int = Integer(brep_cp.Distance)
sort_2 = SortList(Keys=int, ValuesA=debrep.Faces)  # -> Keys, ValuesA
cset = CreateSet(List=sort_2.Keys)  # -> Set, Map
item = ListItem(List=cset.Set, Index=0, Wrap=True)
panel = Panel("""0
1""")
mindex = MemberIndex(Set=sort_2.Keys, Member=item)  # -> Index, Count
Z = UnitZ(Factor=1)
item_2 = ListItem(List=sort.ValuesA, Index=reverse(panel), Wrap=True)
edges = BrepEdges(Brep=dispatch.ListA)  # -> Naked, Interior, NonManifold
edgesdir = EdgesFromDirections(Brep=dispatch.ListA, Directions=Z, Reflex=True, Angle=0)  # -> Edges, Indices, Map
item_3 = ListItem(List=sort_2.ValuesA, Index=mindex.Index, Wrap=True)
Z_2 = UnitZ(Factor=1)
flip = FlipMatrix(Data=edgesdir.Edges)
edgesdir_2 = EdgesFromDirections(Brep=srf, Directions=Z_2, Reflex=True, Angle=0)  # -> Edges, Indices, Map
edges_2 = BrepEdges(Brep=srf)  # -> Naked, Interior, NonManifold
evalsrf_3 = EvaluateSurface(Surface=reparameterize(item_2), Point="0.5,0.5")  # -> Point, Normal, UDirection, VDirection, Frame
cull_i = CullIndex(List=edges.Naked, Indices=edgesdir.Indices, Wrap=True)
cull_i_2 = CullIndex(List=edges_2.Naked, Indices=edgesdir_2.Indices, Wrap=True)
flip_2 = FlipMatrix(Data=cull_i)
srf_2 = Surface(dispatch.ListA)
srf_cp = SurfaceClosestPoint(Point=simplify(flatten(evalsrf_3.Frame)), Surface=graft(srf_2))  # -> Point, UVPoint, Distance
loft = Loft(Curves=flip, Options={Adjust=False, Closed=False, LoftEnds=0, LoftSimp=0, LoftType=0, Rebuild=10, Refit=0.01})
loft_2 = Loft(Curves=flip_2, Options={Adjust=False, Closed=False, LoftEnds=0, LoftSimp=0, LoftType=0, Rebuild=10, Refit=0.01})
sort_3 = SortList(Keys=srf_cp.Distance, ValuesA=flatten(item_2))  # -> Keys, ValuesA
support_sheet_thickness_4 = RemoteReceiver(support_sheet_thickness_2)
support_sheet_thickness_5 = RemoteReceiver(support_sheet_thickness_2)
support_sheet_thickness_6 = RemoteReceiver(support_sheet_thickness_2)
support_sheet_thickness_7 = RemoteReceiver(support_sheet_thickness_2)
item_4 = ListItem(List=sort_3.ValuesA, Index=0, Wrap=True)
neg_4 = Negative(Value=support_sheet_thickness_4)
neg_5 = Negative(Value=support_sheet_thickness_5)
neg_6 = Negative(Value=support_sheet_thickness_6)
neg_7 = Negative(Value=support_sheet_thickness_7)
merge = Merge(Data1=simplify(graft(item_4)), Data2=simplify(graft(dispatch.ListA)))
merge_2 = Merge(Data1=support_sheet_thickness_4, Data2=neg_4)
merge_3 = Merge(Data1=support_sheet_thickness_5, Data2=neg_5)
merge_4 = Merge(Data1=support_sheet_thickness_6, Data2=neg_6)
merge_5 = Merge(Data1=support_sheet_thickness_7, Data2=neg_7)
offsrf_4 = OffsetSurface(Surface=graft(loft), Distance=merge_2, BothSides=0, CreateSolid=True)  # -> simplify(Offset)
offsrf_5 = OffsetSurface(Surface=graft(loft), Distance=merge_3, BothSides=0, CreateSolid=invert(True))  # -> simplify(Offset)
offsrf_6 = OffsetSurface(Surface=graft(loft_2), Distance=merge_4, BothSides=0, CreateSolid=True)  # -> simplify(Offset)
offsrf_7 = OffsetSurface(Surface=graft(loft_2), Distance=merge_5, BothSides=0, CreateSolid=invert(True))  # -> simplify(Offset)
loft_3 = Loft(Curves=merge, Options={Adjust=False, Closed=False, LoftEnds=0, LoftSimp=0, LoftType=0, Rebuild=10, Refit=0.01})
pshift = ShiftPaths(Data=offsrf_5, Offset=-1)
pshift_2 = ShiftPaths(Data=offsrf_7, Offset=-1)
merge_6 = Merge(Data1=merge, Data2=loft_3)
evalsrf_4 = EvaluateSurface(Surface=reparameterize(pshift), Point="0.5,0.5")  # -> Point, Normal, UDirection, VDirection, Frame
evalsrf_5 = EvaluateSurface(Surface=reparameterize(pshift_2), Point="0.5,0.5")  # -> Point, Normal, UDirection, VDirection, Frame
border_3 = RemoteReceiver(border)
border_4 = RemoteReceiver(border)
join = BrepJoin(Breps=merge_6)  # -> Breps, Closed
pshift_3 = ShiftPaths(Data=offsrf_4, Offset=-1)
brepinc_2 = PointInBrep(Brep=border_3, Point=evalsrf_4.Point, Strict=False)
pshift_4 = ShiftPaths(Data=offsrf_6, Offset=-1)
brepinc_3 = PointInBrep(Brep=border_4, Point=evalsrf_5.Point, Strict=False)
dispatch_2 = Dispatch(List=pshift_3, DispatchPattern=brepinc_2)  # -> ListA, ListB
dispatch_3 = Dispatch(List=pshift_4, DispatchPattern=brepinc_3)  # -> ListA, ListB
brep = Brep(dispatch_2.ListA)
brep_2 = Brep(dispatch_3.ListA)
merge_7 = Merge(Data1=brep, Data2=brep_2)  # -> flatten(Result)
sunion = SolidUnion(Breps=merge_7)
fmerge = MergeFaces(Brep=sunion)  # -> Breps, Before, After
merge_8 = Merge(Data1=join.Breps, Data2=fmerge.Breps)  # -> flatten(Result)
support = RemoteSender(merge_8)
support_2 = RemoteReceiver(support)
support_3 = ClusterOutput(support_2)

# ==== cluster Cluster_4
number_slider = Slider(1, range=0..1)
support_sheet_thickness = ClusterInput()
sorted_flow_surface = ClusterInput()
flow_curve_0_final = ClusterInput()
flow_curve_1_final = ClusterInput()
support_width = ClusterInput()
support_sheet_thickness_2 = RemoteSender(support_sheet_thickness)
sorted_flow_surface_2 = RemoteSender(sorted_flow_surface)
flow_curve_0_final_2 = RemoteSender(flow_curve_0_final)
flow_curve_1_final_2 = RemoteSender(flow_curve_1_final)
support_width_2 = RemoteSender(support_width)
support_width_3 = RemoteReceiver(support_width_2)
support_width_4 = RemoteReceiver(support_width_2)
sorted_flow_surface_3 = RemoteReceiver(sorted_flow_surface_2)
flow_curve_1_final_3 = RemoteReceiver(flow_curve_1_final_2)
flow_curve_0_final_3 = RemoteReceiver(flow_curve_0_final_2)
_2 = Integer(2)
_2_2 = Integer(2)
division = Division(A=support_width_3, B=_2)
division_2 = Division(A=support_width_4, B=_2_2)
flow = Flow(
    Geometry=simplify(sorted_flow_surface_3),
    Base=simplify(flatten(flow_curve_1_final_3)),
    Target=simplify(flatten(flow_curve_0_final_3)),
    ReverseBase=False,
    ReverseTarget=False,
    Stretch=True,
    Rigid=False)
neg = Negative(Value=division)
neg_2 = Negative(Value=division_2)
offsrf = OffsetSurface(Surface=graft(flow), Distance=division, BothSides=neg, CreateSolid=True)
offsrf_2 = OffsetSurface(Surface=graft(flow), Distance=division_2, BothSides=neg_2, CreateSolid=invert(True))
support_sheet_thickness_3 = RemoteReceiver(support_sheet_thickness_2)
debrep = DeconstructBrep(Brep=offsrf)  # -> Faces, Edges, Vertices
border = RemoteSender(offsrf)
neg_3 = Negative(Value=support_sheet_thickness_3)
evalsrf = EvaluateSurface(Surface=reparameterize(debrep.Faces), Point="0.5,0.5")  # -> Point, Normal, UDirection, VDirection, Frame
offsrf_3 = OffsetSurface(Surface=graft(offsrf_2), Distance=support_sheet_thickness_3, BothSides=neg_3, CreateSolid=invert(True))  # -> simplify(Offset)
evalsrf_2 = EvaluateSurface(Surface=reparameterize(offsrf_3), Point="0.5,0.5")  # -> Point, Normal, UDirection, VDirection, Frame
_1 = Integer(1)
border_2 = RemoteReceiver(border)
shfdep = ShiftToDepth(Tree=evalsrf_2.Point, Depth=_1, shiftFromStart=False)
_1_2 = Integer(1)
brepinc = PointInBrep(Brep=simplify(border_2), Point=simplify(shfdep), Strict=False)
shfdep_2 = ShiftToDepth(Tree=offsrf_3, Depth=_1_2, shiftFromStart=False)
dispatch = Dispatch(List=shfdep_2, DispatchPattern=brepinc)  # -> simplify(ListA), ListB
area = Area(Geometry=debrep.Faces)  # -> Area, Centroid
sort = SortList(Keys=area.Area, ValuesA=debrep.Faces)  # -> Keys, reverse(ValuesA)
panel = Panel("""0
1""")
srf = Surface(dispatch.ListA)
brep_cp = BrepClosestPoint(Point=evalsrf.Point, Brep=srf)  # -> Point, Normal, Distance
int = Integer(brep_cp.Distance)
sort_2 = SortList(Keys=int, ValuesA=debrep.Faces)  # -> Keys, ValuesA
cset = CreateSet(List=sort_2.Keys)  # -> Set, Map
item = ListItem(List=cset.Set, Index=0, Wrap=True)
mindex = MemberIndex(Set=sort_2.Keys, Member=item)  # -> Index, Count
item_2 = ListItem(List=sort.ValuesA, Index=reverse(panel), Wrap=True)
item_3 = ListItem(List=sort_2.ValuesA, Index=mindex.Index, Wrap=True)
Z = UnitZ(Factor=1)
edgesdir = EdgesFromDirections(Brep=srf, Directions=Z, Reflex=True, Angle=0)  # -> Edges, Indices, Map
edges = BrepEdges(Brep=srf)  # -> Naked, Interior, NonManifold
evalsrf_3 = EvaluateSurface(Surface=reparameterize(item_2), Point="0.5,0.5")  # -> Point, Normal, UDirection, VDirection, Frame
cull_i = CullIndex(List=edges.Naked, Indices=edgesdir.Indices, Wrap=True)
srf_2 = Surface(dispatch.ListA)
srf_cp = SurfaceClosestPoint(Point=simplify(flatten(evalsrf_3.Frame)), Surface=graft(srf_2))  # -> Point, UVPoint, Distance
sort_3 = SortList(Keys=srf_cp.Distance, ValuesA=flatten(item_2))  # -> Keys, ValuesA
item_4 = ListItem(List=sort_3.ValuesA, Index=0, Wrap=True)
merge = Merge(Data1=simplify(graft(item_4)), Data2=simplify(graft(dispatch.ListA)))
loft = Loft(Curves=merge, Options={Adjust=False, Closed=False, LoftEnds=0, LoftSimp=0, LoftType=0, Rebuild=10, Refit=0.01})
merge_2 = Merge(Data1=merge, Data2=loft)
join = BrepJoin(Breps=merge_2)  # -> Breps, Closed
_1_3 = Integer(1)
shfdep_3 = ShiftToDepth(Tree=edgesdir.Edges, Depth=_1_3, shiftFromStart=False)
shfdep_4 = ShiftToDepth(Tree=join.Breps, Depth=Slider(1, range=0..1), shiftFromStart=False)
join_2 = JoinCurves(Curves=shfdep_3, Preserve=False)
midpt = CurveMiddle(Curve=join_2)
_1_4 = Integer(1)
shfdep_5 = ShiftToDepth(Tree=cull_i, Depth=_1_4, shiftFromStart=False)
pdecon = Deconstruct(Point=midpt)  # -> XComponent, YComponent, ZComponent
join_3 = JoinCurves(Curves=shfdep_5, Preserve=False)
int_2 = Integer(pdecon.ZComponent)
midpt_2 = CurveMiddle(Curve=join_3)
sort_4 = SortList(Keys=int_2)  # -> Keys, ValuesA
pdecon_2 = Deconstruct(Point=midpt_2)  # -> XComponent, YComponent, ZComponent
cset_2 = CreateSet(List=sort_4.Keys)  # -> Set, Map
int_3 = Integer(pdecon_2.ZComponent)
int_4 = Integer(cset_2.Set)
sort_5 = SortList(Keys=int_3)  # -> Keys, ValuesA
mindex_2 = MemberIndex(Set=int_2, Member=int_4)  # -> Index, Count
cset_3 = CreateSet(List=sort_5.Keys)  # -> Set, Map
_1_5 = Integer(1)
shfdep_6 = ShiftToDepth(Tree=mindex_2.Index, Depth=_1_5, shiftFromStart=False)
int_5 = Integer(cset_3.Set)
item_5 = ListItem(List=simplify(join_2), Index=simplify(shfdep_6), Wrap=True)
mindex_3 = MemberIndex(Set=flatten(int_3), Member=int_5)  # -> Index, Count
_2_3 = Integer(2)
item_6 = ListItem(List=flatten(join_3), Index=mindex_3.Index, Wrap=True)
partition = PartitionList(List=item_5, Size=_2_3)
support_sheet_thickness_4 = RemoteReceiver(support_sheet_thickness_2)
loft_2 = Loft(Curves=partition, Options={Adjust=False, Closed=False, LoftEnds=0, LoftSimp=0, LoftType=0, Rebuild=10, Refit=0.01})
loft_3 = Loft(Curves=item_6, Options={Adjust=False, Closed=False, LoftEnds=0, LoftSimp=0, LoftType=0, Rebuild=10, Refit=0.01})
_1_6 = Integer(1)
support_sheet_thickness_5 = RemoteReceiver(support_sheet_thickness_2)
_1_7 = Integer(1)
shfdep_7 = ShiftToDepth(Tree=simplify(loft_3), Depth=_1_6, shiftFromStart=False)
shfdep_8 = ShiftToDepth(Tree=simplify(loft_2), Depth=_1_7, shiftFromStart=False)
neg_4 = Negative(Value=support_sheet_thickness_4)
neg_5 = Negative(Value=support_sheet_thickness_5)
entwine = Entwine(Branch00=support_sheet_thickness_5, Branch01=neg_5, FlattenInputs=True)
entwine_2 = Entwine(Branch00=support_sheet_thickness_4, Branch01=neg_4, FlattenInputs=True)
offsrf_4 = OffsetSurface(Surface=flatten(shfdep_7), Distance=simplify(entwine), BothSides=simplify(graft(0)), CreateSolid=True)  # -> simplify(Offset)
offsrf_5 = OffsetSurface(Surface=flatten(shfdep_8), Distance=simplify(entwine_2), BothSides=simplify(graft(0)), CreateSolid=True)  # -> simplify(Offset)
area_2 = Area(Geometry=offsrf_4)  # -> Area, Centroid
area_3 = Area(Geometry=offsrf_5)  # -> Area, Centroid
border_3 = RemoteReceiver(border)
border_4 = RemoteReceiver(border)
brepinc_2 = PointInBrep(Brep=simplify(border_3), Point=simplify(flatten(area_2.Centroid)), Strict=False)
brepinc_3 = PointInBrep(Brep=simplify(border_4), Point=simplify(flatten(area_3.Centroid)), Strict=False)
dispatch_2 = Dispatch(List=flatten(offsrf_4), DispatchPattern=brepinc_2)  # -> ListA, ListB
dispatch_3 = Dispatch(List=flatten(offsrf_5), DispatchPattern=brepinc_3)  # -> ListA, ListB
brep = Brep(dispatch_2.ListA)
brep_2 = Brep(dispatch_3.ListA)
join_4 = BrepJoin(Breps=brep)  # -> Breps, Closed
join_5 = BrepJoin(Breps=brep_2)  # -> Breps, Closed
sunion = SolidUnion(Breps=join_4.Breps)
sunion_2 = SolidUnion(Breps=join_5.Breps)
debrep_2 = DeconstructBrep(Brep=sunion)  # -> Faces, Edges, Vertices
_1_8 = Integer(1)
shfdep_9 = ShiftToDepth(Tree=debrep_2.Faces, Depth=_1_8, shiftFromStart=False)
join_6 = BrepJoin(Breps=shfdep_9)  # -> Breps, Closed
sdiff = SolidDifference(BrepsA=sunion_2, BrepsB=flatten(join_6.Breps))
area_4 = Area(Geometry=sdiff)  # -> Area, Centroid
border_5 = RemoteReceiver(border)
brepinc_4 = PointInBrep(Brep=simplify(border_5), Point=simplify(area_4.Centroid), Strict=False)
dispatch_4 = Dispatch(List=sdiff, DispatchPattern=brepinc_4)  # -> ListA, ListB
brep_3 = Brep(dispatch_4.ListA)
merge_3 = Merge(Data1=simplify(shfdep_4), Data2=join_6.Breps, Data3=brep_3)  # -> graft(Result)
border_6 = RemoteReceiver(border)
splitmul = SplitBrepMultiple(Brep=merge_3, Cutters=border_6)
area_5 = Area(Geometry=splitmul)  # -> Area, Centroid
sort_6 = SortList(Keys=area_5.Area, ValuesA=splitmul)  # -> Keys, ValuesA
item_7 = ListItem(List=reverse(sort_6.ValuesA), Index=0, Wrap=True)
support = RemoteSender(item_7)
support_2 = RemoteReceiver(support)
support_3 = ClusterOutput(support_2)

# ==== cluster Cluster_7
corner_lenght = ClusterInput()
move_vector = ClusterInput()
flowcurve1 = ClusterInput()
no_points = ClusterInput()
seed = ClusterInput()
row_no = ClusterInput()
bake = ClusterInput()
move_vector_2 = RemoteSender(move_vector)
corner_lenght_2 = RemoteSender(corner_lenght)
flow_curve_0 = ClusterInput()
surface_to_flow = ClusterInput()
bake_2 = RemoteSender(bake)
flowcurve1_2 = RemoteSender(flowcurve1)
no_points_2 = RemoteSender(no_points)
seed_2 = RemoteSender(seed)
row_no_2 = RemoteSender(row_no)
surface_to_flow_2 = RemoteSender(surface_to_flow)
flow_curve_0_2 = RemoteSender(flow_curve_0)
flowcurve1_3 = RemoteReceiver(flowcurve1_2)
surface_to_flow_3 = RemoteReceiver(surface_to_flow_2)
len = Length(Curve=flowcurve1_3)
row_no_3 = RemoteReceiver(row_no_2)
step = ClusterInput()
no_points_3 = RemoteReceiver(no_points_2)
surface_to_flow_4 = RemoteReceiver(surface_to_flow_2)
join = BrepJoin(Breps=surface_to_flow_3)  # -> Breps, Closed
step_2 = RemoteSender(step)
xz = XZPlane(Origin=Point(0, 0, 0))
area = Area(Geometry=join.Breps)  # -> Area, Centroid
surface_to_flow_5 = RemoteReceiver(surface_to_flow_2)
corner_lenght_3 = RemoteReceiver(corner_lenght_2)
sunion = SolidUnion(Breps=surface_to_flow_4)
brec = BoundingRectangle(Geometry=surface_to_flow_5, Plane=xz, Axis=0, Slide=0, Union=True)  # -> Bounding, DimensionX, DimensionY
scale = Scale(Geometry=join.Breps, Center=area.Centroid, Factor=Slider(0.8, range=0..1))  # -> Geometry, Transform
divlength = DivideLength(Curve=join.Breps, Length=corner_lenght_3)  # -> Points, Tangents, Parameters
divide = DivideCurve(Curve=sunion, Count=Slider(81, range=0..100), Kinks=False)  # -> Points, Tangents, Parameters
step_3 = RemoteReceiver(step_2)
_2d_frame = RemoteSender(brec.Bounding)
_2d_frame_2 = RemoteReceiver(_2d_frame)
move_vector_3 = RemoteReceiver(move_vector_2)
no_points_4 = RemoteReceiver(no_points_2)
explode = Explode(Curve=step_3, Recursive=True)  # -> Segments, Vertices
seed_3 = RemoteReceiver(seed_2)
pop2d = Populate2D(Region=scale.Geometry, Count=no_points_4, Seed=seed_3, Points=divide.Points)
Y = UnitY(Factor=move_vector_3)
divide_2 = DivideCurve(Curve=explode.Segments, Count=Slider(2, range=0..10), Kinks=False)  # -> Points, Tangents, Parameters
surface_to_flow_6 = RemoteReceiver(surface_to_flow_2)
sunion_2 = SolidUnion(Breps=surface_to_flow_6)
divide_3 = DivideCurve(Curve=sunion_2, Count=Slider(81, range=0..100), Kinks=False)  # -> Points, Tangents, Parameters
srf_cp = SurfaceClosestPoint(Point=pop2d, Surface=sunion_2)  # -> Point, UVPoint, Distance
flow_curve_0_3 = RemoteReceiver(flow_curve_0_2)
_2d_frame_3 = RemoteReceiver(_2d_frame)
int = Integer(srf_cp.Distance)
_0 = Integer(0)
equals = Equality(FirstNumber=int, SecondNumber=_0)  # -> Equality, Inequality
dispatch = Dispatch(List=pop2d, DispatchPattern=equals.Equality)  # -> ListA, ListB
merge = Merge(Data1=flatten(dispatch.ListA))
lng = ListLength(List=merge)
division = Division(A=lng, B=row_no_3)
round = Round(Number=division)  # -> Nearest, Floor, Ceiling
series = Series(Start=0, Step=round.Ceiling, Count=row_no_3)
series_2 = Series(Start=series, Step=1, Count=round.Ceiling)
item = ListItem(List=merge, Index=series_2, Wrap=True)
move = Move(Geometry=item, Motion=graft(Y))  # -> Geometry, Transform
merge_2 = Merge(Data1=move.Geometry, Data2=divide_3.Points, Data3=divide_2.Points)  # -> flatten(Result)
cullpt = CullDuplicates(Points=merge_2, Tolerance=0.1, CullMode=1)  # -> Points, Indices, Valence
entwine = Entwine(Branch00=flow_curve_0_3, Branch01=cullpt.Points, Branch02=_2d_frame_3, FlattenInputs=True)
output = RemoteSender(entwine)
output_2 = RemoteReceiver(output)
output_3 = ClusterOutput(output_2)

# ==== cluster Cluster_9
curve = ClusterInput()
curve_2 = RemoteSender(curve)
curve_3 = RemoteReceiver(curve_2)
explode = Explode(Curve=simplify(curve_3), Recursive=True)  # -> Segments, Vertices
tmatch = MatchText(Text=explode.Segments, Pattern="Arc-like Curve", Case=True)
dispatch = Dispatch(List=explode.Segments, DispatchPattern=tmatch)  # -> ListA, ListB
end = EndPoints(Curve=dispatch.ListB)  # -> Start, End
vec2pt = Vector2Pt(PointA=end.Start, PointB=end.End, Unitize=invert(False))  # -> Vector, Length
cset = CreateSet(List=vec2pt.Vector)  # -> Set, Map
mindex = MemberIndex(Set=vec2pt.Vector, Member=graft(cset.Set))  # -> simplify(Index), Count
item = ListItem(List=dispatch.ListB, Index=mindex.Index, Wrap=True)  # -> simplify(Item)
end_2 = EndPoints(Curve=item)  # -> Start, End
merge = Merge(Data1=end_2.Start, Data2=end_2.End)
cullpt = CullDuplicates(Points=merge, Tolerance=0.1, CullMode=2)  # -> Points, Indices, Valence
pline = PolyLine(Vertices=cullpt.Points, Closed=False)
merge_2 = Merge(Data1=pline, Data2=dispatch.ListA)  # -> flatten(Result)
join = JoinCurves(Curves=merge_2, Preserve=False)
curve_4 = RemoteReceiver(curve_2)
flip = FlipCurve(Curve=join, Guide=curve_4)  # -> Curve, Flag
cleaned_curve = RemoteSender(flip.Curve)
cleaned_curve_2 = RemoteReceiver(cleaned_curve)
cleaned_curve_3 = ClusterOutput(cleaned_curve_2)

# ==== cluster Cluster_10
flow_curve_0 = ClusterInput()
flow_curve_1 = ClusterInput()
cut_points_0 = ClusterInput()
beam_type = ClusterInput()
beam_width = ClusterInput()
riserdistribution = ClusterInput()
flow_curve_0_2 = RemoteSender(flow_curve_0)
flow_curve_1_2 = RemoteSender(flow_curve_1)
cut_points_0_2 = RemoteSender(cut_points_0)
beam_width_2 = RemoteSender(beam_width)
beam_type_2 = RemoteSender(beam_type)
riserdistribution_2 = RemoteSender(riserdistribution)
flow_curve_0_3 = RemoteReceiver(flow_curve_0_2)
cut_points_0_3 = RemoteReceiver(cut_points_0_2)
join = JoinCurves(Curves=flatten(flow_curve_0_3), Preserve=False)
crv_cp = CurveClosestPoint(Point=cut_points_0_3, Curve=join)  # -> Point, Parameter, Distance
shatter = Shatter(Curve=join, Parameters=crv_cp.Parameter)
panel = Panel("""-1
0""")
beam_width_3 = RemoteReceiver(beam_width_2)
_2 = Integer(2)
item = ListItem(List=shatter, Index=0, Wrap=True)
cull_i = CullIndex(List=shatter, Indices=panel, Wrap=True)
item_2 = ListItem(List=shatter, Index=0, Wrap=True)  # -> Item1, Item
beam_width_4 = RemoteReceiver(beam_width_2)
beam_width_5 = RemoteReceiver(beam_width_2)
division = Division(A=beam_width_3, B=_2)
neg = Negative(Value=division)
neg_2 = Negative(Value=division)
_0 = Integer(0)
_0_2 = Integer(0)
cut_points_0_4 = RemoteReceiver(cut_points_0_2)
ext = ExtendCurve(Curve=item, Type=0, Start=_0, End=division)
ext_2 = ExtendCurve(Curve=cull_i, Type=0, Start=neg_2, End=division)
ext_3 = ExtendCurve(Curve=item_2.Item1, Type=0, Start=neg, End=_0_2)
flow_curve_0_4 = RemoteReceiver(flow_curve_0_2)
null = NullItem(Item=cut_points_0_4)  # -> NullFlags, InvalidFlags, Description
entwine = Entwine(Branch00=ext, Branch01=ext_2, Branch02=ext_3, FlattenInputs=True)  # -> flatten(Result)
filter = StreamFilter(Gate=null.NullFlags, Stream0=entwine, Stream1=flow_curve_0_4)
flow_curve_1_3 = RemoteReceiver(flow_curve_1_2)
beam_type_3 = RemoteReceiver(beam_type_2)
_2_2 = Integer(2)
flow_curve_0_5 = RemoteReceiver(flow_curve_0_2)
join_2 = JoinCurves(Curves=flatten(flow_curve_1_3), Preserve=False)
equals = Equality(FirstNumber=beam_type_3, SecondNumber=_2_2)  # -> Equality, Inequality
len = Length(Curve=filter)  # -> flatten(Length)
join_3 = JoinCurves(Curves=flatten(flow_curve_0_5), Preserve=False)
len_2 = Length(Curve=join_2)
riserdistribution_3 = RemoteReceiver(riserdistribution_2)
flow_curve_0_6 = RemoteReceiver(flow_curve_0_2)
filter_2 = StreamFilter(Gate=equals.Equality, Stream0=filter, Stream1=join_3)
cull_i_2 = CullIndex(List=len, Indices="-1", Wrap=True)
crvdom = CurveDomain(Curve=join_2, Domain=len_2)  # -> Curve, Domain
flow_curve_1_4 = RemoteReceiver(flow_curve_1_2)
beam_type_4 = RemoteReceiver(beam_type_2)
_2_3 = Integer(2)
ma = MassAddition(Input=cull_i_2)  # -> Result, PartialResults
join_4 = JoinCurves(Curves=flatten(flow_curve_1_4), Preserve=False)
filter_3 = StreamFilter(Gate=riserdistribution_3, Stream0=flow_curve_0_6, Stream1=filter_2, Stream2=filter_2, Stream3=filter_2)
equals_2 = Equality(FirstNumber=beam_type_4, SecondNumber=_2_3)  # -> Equality, Inequality
shatter_2 = Shatter(Curve=crvdom.Curve, Parameters=ma.PartialResults)  # -> flatten(Segments)
riserdistribution_4 = RemoteReceiver(riserdistribution_2)
flow_curve_1_5 = RemoteReceiver(flow_curve_1_2)
flow_curve_0_final = RemoteSender(filter_3)
filter_4 = StreamFilter(Gate=equals_2.Equality, Stream0=shatter_2, Stream1=join_4)
flow_curve_0_final_2 = RemoteReceiver(flow_curve_0_final)
filter_5 = StreamFilter(Gate=riserdistribution_4, Stream0=flow_curve_1_5, Stream1=filter_4, Stream2=filter_4, Stream3=filter_4)
len_3 = Length(Curve=flow_curve_0_final_2)
flow_curve_1_final = RemoteSender(filter_5)
ma_2 = MassAddition(Input=len_3)  # -> Result, PartialResults
cull_i_3 = CullIndex(List=ma_2.PartialResults, Indices="-1", Wrap=True)
pt = ConstructPoint(XCoordinate=cull_i_3, YCoordinate=0, ZCoordinate=0)
flow_curve_0_final_3 = RemoteReceiver(flow_curve_0_final)
flow_curve_1_final_2 = RemoteReceiver(flow_curve_1_final)
cut_points_1 = RemoteSender(pt)
cut_points_1_2 = RemoteReceiver(cut_points_1)
flow_curve_0_final_4 = ClusterOutput(flow_curve_0_final_3)
flow_curve_1_final_3 = ClusterOutput(flow_curve_1_final_2)
cut_points_1_3 = ClusterOutput(cut_points_1_2)
